# Grasshopper definition Appendiks D Grashopperscript.gh (Grasshopper 1.0.8)
# plug-ins: Pufferfish, OpenNest

# ----
# Konstanter
# Objekt
# Løkkens størrelse
# Løkkes hældning
# Placering
# "Reb" længde
width = Slider(1, range=0..10)
height = Slider(1, range=0..10)
placering_x = Slider(0.152, range=-10..10)
bredde = Slider(0.742, range=0..10)
længde = Slider(1.023, range=0..10)
theta = Slider(3, range=0..10)
placering_y = Slider(0, range=-10..10)
placering_z = Slider(-0.996, range=-10..10)
reb_længde = Slider(2.639, range=0..10)
reb_længde_2 = Slider(3.068, range=0..10)
# Scalering
number_slider = Slider(5000, range=0..5000)

# ----
# Hældning
expression = Expression(x=theta, Expression="π/x")
expression_2 = Expression(x=expression, Expression="-sin(x)")
expression_3 = Expression(x=expression, Expression="cos(x)")
expression_4 = Expression(x=expression, Expression="sin(x)")
expression_5 = Expression(x=expression, Expression="cos(x)")
vec = VectorXYZ(XComponent=expression_3, YComponent="0", ZComponent=expression_2)  # -> Vector, Length
vec_2 = VectorXYZ(XComponent="0", YComponent="1", ZComponent="0")  # -> Vector, Length
vec_3 = VectorXYZ(XComponent=expression_4, YComponent="0", ZComponent=expression_5)  # -> Vector, Length

# ----
# t-værdier
expression_6 = Expression(Expression="π/2")
expression_7 = Expression(Expression="π")
dom = ConstructDomain(DomainStart="0", DomainEnd=expression_6)
dom_2 = ConstructDomain(DomainStart="0", DomainEnd=expression_7)
dom_3 = ConstructDomain(DomainStart="0", DomainEnd=reb_længde)
dom_4 = ConstructDomain(DomainStart="0", DomainEnd=reb_længde_2)
range = Range(Domain=dom, Steps=Slider(100, range=0..1000))
range_2 = Range(Domain=dom_2, Steps=Slider(100, range=0..1000))
range_3 = Range(Domain=dom_3, Steps=Slider(100, range=0..1000))
range_4 = Range(Domain=dom_4, Steps=Slider(100, range=0..1000))

vec_4 = VectorXYZ(XComponent=placering_x, YComponent=placering_y, ZComponent=placering_z)  # -> Vector, Length

# ----
# Make Rektange i xz-plan
vec_5 = VectorXYZ(XComponent=width, YComponent=width, ZComponent=height)  # -> Vector, Length

# ----
# cirk1
expression_8 = Expression(t=range, Expression="-1+cos(t)")
expression_9 = Expression(t=range, Expression="2-sin(t)")
vec_6 = VectorXYZ(XComponent=expression_8, YComponent=expression_9, ZComponent="0")  # -> Vector, Length
devec = DeconstructVector(Vector=vec_6.Vector)  # -> XComponent, YComponent, ZComponent
multiplication = Multiplication(A=længde, B=devec.XComponent)
multiplication_2 = Multiplication(A=bredde, B=devec.YComponent)
multiplication_3 = Multiplication(A=devec.ZComponent, B=længde)
vec_7 = VectorXYZ(XComponent=multiplication, YComponent=multiplication_2, ZComponent=multiplication_3)  # -> Vector, Length
pline = PolyLine(Vertices=vec_7.Vector, Closed=False)
item = ListItem(List=vec_7.Vector, Index="0", Wrap=True)
eval = EvaluateCurve(Curve=pline, Parameter=item)  # -> Point, Tangent, Angle
pl = PlaneNormal(Origin=eval.Point, ZAxis=eval.Tangent)
rec_2pt = Rectangle2Pt(Plane=pl, PointA=Point(0, 0, 0), PointB=vec_5.Vector, Radius=0)  # -> Rectangle, Length
pcen = PolygonCenter(Polyline=rec_2pt.Rectangle)  # -> CenterV, CenterE, CenterA
orient = Orient(Geometry=rec_2pt.Rectangle, Source=pcen.CenterV, Target=item)  # -> Geometry, Transform
arrcurve = CurveArray(Geometry=orient.Geometry, Curve=pline, Count=10)  # -> Geometry, Transform
loft = Loft(
    Curves=reparameterize(arrcurve.Geometry),
    Options={Adjust=False, Closed=False, LoftEnds=0, LoftSimp=0, LoftType=0, Rebuild=10, Refit=0.01})

# ----
# cyl2
expression_10 = Expression(u=range_4, Expression="-1-u")
vec_8 = VectorXYZ(XComponent=expression_10, YComponent="-1", ZComponent="0")  # -> Vector, Length
devec_2 = DeconstructVector(Vector=vec_8.Vector)  # -> XComponent, YComponent, ZComponent
expression_11 = Expression(x=længde, y=devec_2.XComponent, Expression="y-x+1")
multiplication_4 = Multiplication(A=bredde, B=devec_2.YComponent)
multiplication_5 = Multiplication(A=devec_2.ZComponent, B=længde)
vec_9 = VectorXYZ(XComponent=expression_11, YComponent=multiplication_4, ZComponent=multiplication_5)  # -> Vector, Length
pline_2 = PolyLine(Vertices=vec_9.Vector, Closed=False)
item_2 = ListItem(List=arrcurve.Geometry, Index="9", Wrap=True)
arrcurve_2 = CurveArray(Geometry=item_2, Curve=pline_2, Count=10)  # -> Geometry, Transform
loft_2 = Loft(
    Curves=reparameterize(arrcurve_2.Geometry),
    Options={Adjust=False, Closed=False, LoftEnds=0, LoftSimp=0, LoftType=0, Rebuild=10, Refit=0.01})

X = UnitX(Factor=1)
X_2 = UnitX(Factor=1)
Y = UnitY(Factor=1)
Y_2 = UnitY(Factor=1)
vec_10 = VectorXYZ(XComponent=0, YComponent=Slider(3, range=-10..10), ZComponent=0)  # -> Vector, Length

expression_12 = Expression(u=range, Expression="-2+1*sin(u)")
# cirk10
expression_13 = Expression(u=range, Expression="1-cos(u)")
vec_11 = VectorXYZ(XComponent=expression_13, YComponent=expression_12, ZComponent="0")  # -> Vector, Length
addition = Addition(A=vec_4.Vector, B=vec_11.Vector)
devec_3 = DeconstructVector(Vector=addition)  # -> XComponent, YComponent, ZComponent
multiplication_6 = Multiplication(A=længde, B=devec_3.XComponent)
multiplication_7 = Multiplication(A=bredde, B=devec_3.YComponent)
multiplication_8 = Multiplication(A=devec_3.ZComponent, B=længde)
vec_12 = VectorXYZ(XComponent=multiplication_6, YComponent=multiplication_7, ZComponent=multiplication_8)  # -> Vector, Length
pline_3 = PolyLine(Vertices=vec_12.Vector, Closed=False)

# ---- group: panel
# cirk3rot
expression_14 = Expression(u=range_2, Expression="-3*sin(u)-1")
expression_15 = Expression(u=range_2, Expression="3*cos(u)")
vec_13 = VectorXYZ(XComponent="0", YComponent=expression_15, ZComponent=expression_14)  # -> Vector, Length
dprod = DotProduct(VectorA=vec.Vector, VectorB=vec_13.Vector, Unitize=False)
dprod_2 = DotProduct(VectorA=vec_2.Vector, VectorB=vec_13.Vector, Unitize=False)
dprod_3 = DotProduct(VectorA=vec_3.Vector, VectorB=vec_13.Vector, Unitize=False)
vec_14 = VectorXYZ(XComponent=dprod, YComponent=dprod_2, ZComponent=dprod_3)  # -> Vector, Length
devec_4 = DeconstructVector(Vector=vec_14.Vector)  # -> XComponent, YComponent, ZComponent
multiplication_9 = Multiplication(A=længde, B=devec_4.XComponent)
multiplication_10 = Multiplication(A=bredde, B=devec_4.YComponent)
multiplication_11 = Multiplication(A=devec_4.ZComponent, B=længde)
vec_15 = VectorXYZ(XComponent=multiplication_9, YComponent=multiplication_10, ZComponent=multiplication_11)  # -> Vector, Length
pline_4 = PolyLine(Vertices=vec_15.Vector, Closed=False)

# ----
# cirk8rot
expression_16 = Expression(u=range_2, Expression="1+3*sin(u)")
expression_17 = Expression(u=range_2, Expression="-3*cos(u)")
vec_16 = VectorXYZ(XComponent="0", YComponent=expression_17, ZComponent=expression_16)  # -> Vector, Length
dprod_4 = DotProduct(VectorA=vec.Vector, VectorB=vec_16.Vector, Unitize=False)
dprod_5 = DotProduct(VectorA=vec_2.Vector, VectorB=vec_16.Vector, Unitize=False)
dprod_6 = DotProduct(VectorA=vec_3.Vector, VectorB=vec_16.Vector, Unitize=False)
vec_17 = VectorXYZ(XComponent=dprod_4, YComponent=dprod_5, ZComponent=dprod_6)  # -> Vector, Length
addition_2 = Addition(A=vec_4.Vector, B=vec_17.Vector)
devec_5 = DeconstructVector(Vector=addition_2)  # -> XComponent, YComponent, ZComponent
multiplication_12 = Multiplication(A=længde, B=devec_5.XComponent)
multiplication_13 = Multiplication(A=bredde, B=devec_5.YComponent)
multiplication_14 = Multiplication(A=devec_5.ZComponent, B=længde)
vec_18 = VectorXYZ(XComponent=multiplication_12, YComponent=multiplication_13, ZComponent=multiplication_14)  # -> Vector, Length
pline_5 = PolyLine(Vertices=vec_18.Vector, Closed=False)
flip = FlipCurve(Curve=pline_5)  # -> Curve, Flag

# ----
# cirk7rot
expression_18 = Expression(u=range, Expression="-sin(u)+1")
expression_19 = Expression(u=range, Expression="2+cos(u)")

# ----
# cirk9rot
expression_20 = Expression(u=range, Expression="-2-cos(u)")
expression_21 = Expression(u=range, Expression="1-sin(u)")
vec_19 = VectorXYZ(XComponent="0", YComponent=expression_20, ZComponent=expression_21)  # -> Vector, Length
dprod_7 = DotProduct(VectorA=vec.Vector, VectorB=vec_19.Vector, Unitize=False)
dprod_8 = DotProduct(VectorA=vec_2.Vector, VectorB=vec_19.Vector, Unitize=False)
dprod_9 = DotProduct(VectorA=vec_19.Vector, VectorB=vec_3.Vector, Unitize=False)
vec_20 = VectorXYZ(XComponent=dprod_7, YComponent=dprod_8, ZComponent=dprod_9)  # -> Vector, Length
addition_3 = Addition(A=vec_4.Vector, B=vec_20.Vector)
devec_6 = DeconstructVector(Vector=addition_3)  # -> XComponent, YComponent, ZComponent
multiplication_15 = Multiplication(A=længde, B=devec_6.XComponent)
multiplication_16 = Multiplication(A=bredde, B=devec_6.YComponent)
multiplication_17 = Multiplication(A=devec_6.ZComponent, B=længde)
vec_21 = VectorXYZ(XComponent=multiplication_15, YComponent=multiplication_16, ZComponent=multiplication_17)  # -> Vector, Length
pline_6 = PolyLine(Vertices=vec_21.Vector, Closed=False)

# ----
# cirk4rot
expression_22 = Expression(u=range, Expression="-2-cos(u)")
expression_23 = Expression(u=range, Expression="-1+sin(u)")
vec_22 = VectorXYZ(XComponent="0", YComponent=expression_22, ZComponent=expression_23)  # -> Vector, Length
dprod_10 = DotProduct(VectorA=vec.Vector, VectorB=vec_22.Vector, Unitize=False)
dprod_11 = DotProduct(VectorA=vec_2.Vector, VectorB=vec_22.Vector, Unitize=False)
dprod_12 = DotProduct(VectorA=vec_3.Vector, VectorB=vec_22.Vector, Unitize=False)
vec_23 = VectorXYZ(XComponent=dprod_10, YComponent=dprod_11, ZComponent=dprod_12)  # -> Vector, Length
devec_7 = DeconstructVector(Vector=vec_23.Vector)  # -> XComponent, YComponent, ZComponent
multiplication_18 = Multiplication(A=længde, B=devec_7.XComponent)
multiplication_19 = Multiplication(A=bredde, B=devec_7.YComponent)
multiplication_20 = Multiplication(A=devec_7.ZComponent, B=længde)
vec_24 = VectorXYZ(XComponent=multiplication_18, YComponent=multiplication_19, ZComponent=multiplication_20)  # -> Vector, Length
pline_7 = PolyLine(Vertices=vec_24.Vector, Closed=False)

# ----
# cirk5
expression_24 = Expression(u=range, Expression="-1+cos(u)")
expression_25 = Expression(u=range, Expression="-2+sin(u)")
vec_25 = VectorXYZ(XComponent=expression_24, YComponent=expression_25, ZComponent="0")  # -> Vector, Length

# ----
# cirk6
expression_26 = Expression(u=range, Expression="1-cos(u)")
expression_27 = Expression(u=range, Expression="2-sin(u)")
vec_26 = VectorXYZ(XComponent=expression_26, YComponent=expression_27, ZComponent="0")  # -> Vector, Length
addition_4 = Addition(A=vec_4.Vector, B=vec_26.Vector)
devec_8 = DeconstructVector(Vector=addition_4)  # -> XComponent, YComponent, ZComponent
multiplication_21 = Multiplication(A=længde, B=devec_8.XComponent)
multiplication_22 = Multiplication(A=bredde, B=devec_8.YComponent)
multiplication_23 = Multiplication(A=devec_8.ZComponent, B=længde)
vec_27 = VectorXYZ(XComponent=multiplication_21, YComponent=multiplication_22, ZComponent=multiplication_23)  # -> Vector, Length
pline_8 = PolyLine(Vertices=vec_27.Vector, Closed=False)
item_3 = ListItem(List=vec_27.Vector, Index="0", Wrap=True)

eval_2 = EvaluateCurve(Curve=pline_8, Parameter=item_3)  # -> Point, Tangent, Angle
pl_2 = PlaneNormal(Origin=eval_2.Point, ZAxis=eval_2.Tangent)

rec_2pt_2 = Rectangle2Pt(Plane=pl_2, PointA=Point(0, 0, 0), PointB=vec_5.Vector, Radius=0)  # -> Rectangle, Length
pcen_2 = PolygonCenter(Polyline=rec_2pt_2.Rectangle)  # -> CenterV, CenterE, CenterA
orient_2 = Orient(Geometry=rec_2pt_2.Rectangle, Source=pcen_2.CenterV, Target=item_3)  # -> Geometry, Transform
arrcurve_3 = CurveArray(Geometry=orient_2.Geometry, Curve=pline_8, Count=10)  # -> Geometry, Transform
loft_3 = Loft(
    Curves=arrcurve_3.Geometry,
    Options={Adjust=False, Closed=False, LoftEnds=0, LoftSimp=0, LoftType=0, Rebuild=10, Refit=0.01})

# ----
# cyl4
expression_28 = Expression(u=range_4, Expression="1+u")
vec_28 = VectorXYZ(XComponent=expression_28, YComponent="-1", ZComponent="0")  # -> Vector, Length
devec_9 = DeconstructVector(Vector=vec_28.Vector)  # -> XComponent, YComponent, ZComponent
expression_29 = Expression(x=længde, y=devec_9.XComponent, Expression="y+x-1")
multiplication_24 = Multiplication(A=bredde, B=devec_9.YComponent)
multiplication_25 = Multiplication(A=devec_9.ZComponent, B=længde)
devec_10 = DeconstructVector(Vector=vec_4.Vector)  # -> XComponent, YComponent, ZComponent
expression_30 = Expression(x=devec_10.XComponent, y=expression_29, z=længde, Expression="y+x*z")
expression_31 = Expression(x=devec_10.YComponent, y=multiplication_24, z=bredde, Expression="y+x*z")
expression_32 = Expression(x=devec_10.ZComponent, y=multiplication_25, z=længde, Expression="y+x*z")
vec_29 = VectorXYZ(XComponent=expression_30, YComponent=expression_31, ZComponent=expression_32)  # -> Vector, Length
pline_9 = PolyLine(Vertices=vec_29.Vector, Closed=False)
item_4 = ListItem(List=arrcurve_3.Geometry, Index="9", Wrap=True)
arrcurve_4 = CurveArray(Geometry=item_4, Curve=pline_9, Count=10)  # -> Geometry, Transform
loft_4 = Loft(
    Curves=arrcurve_4.Geometry,
    Options={Adjust=False, Closed=False, LoftEnds=0, LoftSimp=0, LoftType=0, Rebuild=10, Refit=0.01})

# ----
# cirk2rot
expression_33 = Expression(t=range, Expression="2+cos(t)")
expression_34 = Expression(t=range, Expression="sin(t)-1")
vec_30 = VectorXYZ(XComponent="0", YComponent=expression_33, ZComponent=expression_34)  # -> Vector, Length
dprod_13 = DotProduct(VectorA=vec.Vector, VectorB=vec_30.Vector, Unitize=False)
dprod_14 = DotProduct(VectorA=vec_2.Vector, VectorB=vec_30.Vector, Unitize=False)
dprod_15 = DotProduct(VectorA=vec_3.Vector, VectorB=vec_30.Vector, Unitize=False)
vec_31 = VectorXYZ(XComponent=dprod_13, YComponent=dprod_14, ZComponent=dprod_15)  # -> Vector, Length
devec_11 = DeconstructVector(Vector=vec_31.Vector)  # -> XComponent, YComponent, ZComponent
multiplication_26 = Multiplication(A=længde, B=devec_11.XComponent)
multiplication_27 = Multiplication(A=bredde, B=devec_11.YComponent)
multiplication_28 = Multiplication(A=devec_11.ZComponent, B=længde)
vec_32 = VectorXYZ(XComponent=multiplication_26, YComponent=multiplication_27, ZComponent=multiplication_28)  # -> Vector, Length
pline_10 = PolyLine(Vertices=vec_32.Vector, Closed=False)

flip_2 = FlipCurve(Curve=pline_10)  # -> Curve, Flag

arrcurve_5 = CurveArray(Geometry=orient.Geometry, Curve=flip_2.Curve, Count=10)  # -> Geometry, Transform
loft_5 = Loft(
    Curves=reparameterize(arrcurve_5.Geometry),
    Options={Adjust=False, Closed=False, LoftEnds=0, LoftSimp=0, LoftType=0, Rebuild=10, Refit=0.01})

# ---- group: panel (continued)
item_5 = ListItem(List=arrcurve_5.Geometry, Index="9", Wrap=True)
arrcurve_6 = CurveArray(Geometry=item_5, Curve=pline_4, Count=10)  # -> Geometry, Transform
loft_6 = Loft(
    Curves=reparameterize(arrcurve_6.Geometry),
    Options={Adjust=False, Closed=False, LoftEnds=0, LoftSimp=0, LoftType=0, Rebuild=10, Refit=0.01})

# ----
item_6 = ListItem(List=arrcurve_6.Geometry, Index="9", Wrap=True)
arrcurve_7 = CurveArray(Geometry=item_6, Curve=pline_7, Count=10)  # -> Geometry, Transform
loft_7 = Loft(
    Curves=reparameterize(arrcurve_7.Geometry),
    Options={Adjust=False, Closed=False, LoftEnds=0, LoftSimp=0, LoftType=0, Rebuild=10, Refit=0.01})

# ----
# cyl1
expression_35 = Expression(u=range_3, Expression="-1-u")

# ----
# cyl3
expression_36 = Expression(u=range_3, Expression="1+u")
vec_33 = VectorXYZ(XComponent=expression_36, YComponent="1", ZComponent="0")  # -> Vector, Length
devec_12 = DeconstructVector(Vector=vec_33.Vector)  # -> XComponent, YComponent, ZComponent
expression_37 = Expression(x=længde, y=devec_12.XComponent, Expression="y+x-1")
multiplication_29 = Multiplication(A=bredde, B=devec_12.YComponent)
multiplication_30 = Multiplication(A=devec_12.ZComponent, B=længde)
devec_13 = DeconstructVector(Vector=vec_4.Vector)  # -> XComponent, YComponent, ZComponent
expression_38 = Expression(x=devec_13.XComponent, y=expression_37, z=længde, Expression="y+x*z")
expression_39 = Expression(x=devec_13.YComponent, y=multiplication_29, z=bredde, Expression="y+x*z")
expression_40 = Expression(x=devec_13.ZComponent, y=multiplication_30, z=længde, Expression="y+x*z")
vec_34 = VectorXYZ(XComponent=expression_38, YComponent=expression_39, ZComponent=expression_40)  # -> Vector, Length
pline_11 = PolyLine(Vertices=vec_34.Vector, Closed=False)

# ----
# Løkke 2
panel = Panel("0")

# ----
# Løkke 1
panel_2 = Panel("1")
devec_14 = DeconstructVector(Vector=vec_25.Vector)  # -> XComponent, YComponent, ZComponent
multiplication_31 = Multiplication(A=bredde, B=devec_14.YComponent)
multiplication_32 = Multiplication(A=devec_14.ZComponent, B=længde)

vec_35 = VectorXYZ(XComponent=panel, YComponent=expression_19, ZComponent=expression_18)  # -> Vector, Length
dprod_16 = DotProduct(VectorA=vec.Vector, VectorB=vec_35.Vector, Unitize=False)
dprod_17 = DotProduct(VectorA=vec_2.Vector, VectorB=vec_35.Vector, Unitize=False)
dprod_18 = DotProduct(VectorA=vec_3.Vector, VectorB=vec_35.Vector, Unitize=False)
vec_36 = VectorXYZ(XComponent=dprod_16, YComponent=dprod_17, ZComponent=dprod_18)  # -> Vector, Length

vec_37 = VectorXYZ(XComponent=expression_35, YComponent=panel_2, ZComponent="0")  # -> Vector, Length
devec_15 = DeconstructVector(Vector=vec_37.Vector)  # -> XComponent, YComponent, ZComponent
expression_41 = Expression(x=længde, y=devec_15.XComponent, Expression="y-x+1")
multiplication_33 = Multiplication(A=bredde, B=devec_15.YComponent)
multiplication_34 = Multiplication(A=devec_15.ZComponent, B=længde)
vec_38 = VectorXYZ(XComponent=expression_41, YComponent=multiplication_33, ZComponent=multiplication_34)  # -> Vector, Length
pline_12 = PolyLine(Vertices=vec_38.Vector, Closed=False)

addition_5 = Addition(A=vec_4.Vector, B=vec_36.Vector)
devec_16 = DeconstructVector(Vector=addition_5)  # -> XComponent, YComponent, ZComponent
multiplication_35 = Multiplication(A=længde, B=devec_16.XComponent)
multiplication_36 = Multiplication(A=bredde, B=devec_16.YComponent)
multiplication_37 = Multiplication(A=devec_16.ZComponent, B=længde)
vec_39 = VectorXYZ(XComponent=multiplication_35, YComponent=multiplication_36, ZComponent=multiplication_37)  # -> Vector, Length

pline_13 = PolyLine(Vertices=vec_39.Vector, Closed=False)
flip_3 = FlipCurve(Curve=pline_13)  # -> Curve, Flag
arrcurve_8 = CurveArray(Geometry=orient_2.Geometry, Curve=flip_3.Curve, Count=10)  # -> Geometry, Transform
loft_8 = Loft(
    Curves=arrcurve_8.Geometry,
    Options={Adjust=False, Closed=False, LoftEnds=0, LoftSimp=0, LoftType=0, Rebuild=10, Refit=0.01})

item_7 = ListItem(List=arrcurve_8.Geometry, Index="9", Wrap=True)
arrcurve_9 = CurveArray(Geometry=item_7, Curve=flip.Curve, Count=10)  # -> Geometry, Transform
loft_9 = Loft(
    Curves=arrcurve_9.Geometry,
    Options={Adjust=False, Closed=False, LoftEnds=0, LoftSimp=0, LoftType=0, Rebuild=10, Refit=0.01})

item_8 = ListItem(List=arrcurve_9.Geometry, Index="9", Wrap=True)
arrcurve_10 = CurveArray(Geometry=item_8, Curve=pline_6, Count=10)  # -> Geometry, Transform
loft_10 = Loft(
    Curves=arrcurve_10.Geometry,
    Options={Adjust=False, Closed=False, LoftEnds=0, LoftSimp=0, LoftType=0, Rebuild=10, Refit=0.01})

item_9 = ListItem(List=arrcurve_10.Geometry, Index="9", Wrap=True)
arrcurve_11 = CurveArray(Geometry=item_9, Curve=pline_3, Count=10)  # -> Geometry, Transform
loft_11 = Loft(
    Curves=arrcurve_11.Geometry,
    Options={Adjust=False, Closed=False, LoftEnds=0, LoftSimp=0, LoftType=0, Rebuild=10, Refit=0.01})

item_10 = ListItem(List=arrcurve_11.Geometry, Index="9", Wrap=True)
arrcurve_12 = CurveArray(Geometry=item_10, Curve=pline_11, Count=10)  # -> Geometry, Transform
loft_12 = Loft(
    Curves=arrcurve_12.Geometry,
    Options={Adjust=False, Closed=False, LoftEnds=0, LoftSimp=0, LoftType=0, Rebuild=10, Refit=0.01})

merge = Merge(Data1=loft_3, Data2=loft_8, Data3=loft_9, Data4=loft_10, Data5=loft_11, Data6=loft_12, Data7=loft_4)

pt = Point(Point(0, 0, 0))
scale = Scale(Geometry=merge, Center=pt, Factor=number_slider)  # -> Geometry, Transform
debrep = DeconstructBrep(Brep=scale.Geometry)  # -> reparameterize(Faces), Edges, Vertices
item_11 = ListItem(List=debrep.Faces, Index="0", Wrap=True)
item_12 = ListItem(List=debrep.Faces, Index="1", Wrap=True)
item_13 = ListItem(List=debrep.Faces, Index="2", Wrap=True)
item_14 = ListItem(List=debrep.Faces, Index="3", Wrap=True)
sdivide = DivideSurface(Surface=item_13, UCount="50", VCount="50")  # -> Points, Normals, Parameters
sdivide_2 = DivideSurface(Surface=item_14, UCount="50", VCount="50")  # -> Points, Normals, Parameters
sdivide_3 = DivideSurface(Surface=item_12, UCount="50", VCount="50")  # -> Points, Normals, Parameters
sdivide_4 = DivideSurface(Surface=item_11, UCount="50", VCount="50")  # -> Points, Normals, Parameters
curvature = SurfaceCurvature(Surface=item_13, Point=sdivide.Parameters)  # -> Frame, Gaussian, Mean
curvature_2 = SurfaceCurvature(Surface=item_14, Point=sdivide_2.Parameters)  # -> Frame, Gaussian, Mean
curvature_3 = SurfaceCurvature(Surface=item_12, Point=sdivide_3.Parameters)  # -> Frame, Gaussian, Mean
curvature_4 = SurfaceCurvature(Surface=item_11, Point=sdivide_4.Parameters)  # -> Frame, Gaussian, Mean
gradient = Gradient(
    LowerLimit="-1",
    UpperLimit="1",
    Parameter=curvature.Gaussian,
    stops=[0: RGB(255, 0, 0), 0.251: RGB(255, 255, 0), 0.492: RGB(0, 128, 0), 0.75: RGB(0, 255, 255), 1: RGB(0, 0, 255)])
gradient_2 = Gradient(
    LowerLimit="-1",
    UpperLimit="1",
    Parameter=curvature_2.Gaussian,
    stops=[0: RGB(255, 0, 0), 0.251: RGB(255, 255, 0), 0.492: RGB(0, 128, 0), 0.75: RGB(0, 255, 255), 1: RGB(0, 0, 255)])
gradient_3 = Gradient(
    LowerLimit="-1",
    UpperLimit="1",
    Parameter=curvature_3.Gaussian,
    stops=[0: RGB(255, 0, 0), 0.251: RGB(255, 255, 0), 0.492: RGB(0, 128, 0), 0.75: RGB(0, 255, 255), 1: RGB(0, 0, 255)])
gradient_4 = Gradient(
    LowerLimit="-1",
    UpperLimit="1",
    Parameter=curvature_4.Gaussian,
    stops=[0: RGB(255, 0, 0), 0.251: RGB(255, 255, 0), 0.492: RGB(0, 128, 0), 0.75: RGB(0, 255, 255), 1: RGB(0, 0, 255)])
panel_3 = Panel(curvature.Gaussian)
panel_4 = Panel(curvature_2.Gaussian)
panel_5 = Panel(curvature_3.Gaussian)
panel_6 = Panel(curvature_4.Gaussian)
preview = CustomPreview(Geometry=sdivide.Points, Material=gradient)
preview_2 = CustomPreview(Geometry=sdivide_2.Points, Material=gradient_2)
preview_3 = CustomPreview(Geometry=sdivide_3.Points, Material=gradient_3)
preview_4 = CustomPreview(Geometry=sdivide_4.Points, Material=gradient_4)

multiplication_38 = Multiplication(A=længde, B=devec_14.XComponent)
item_15 = ListItem(List=arrcurve_7.Geometry, Index="9", Wrap=True)

vec_40 = VectorXYZ(XComponent=multiplication_38, YComponent=multiplication_31, ZComponent=multiplication_32)  # -> Vector, Length

pline_14 = PolyLine(Vertices=vec_40.Vector, Closed=False)
arrcurve_13 = CurveArray(Geometry=item_15, Curve=pline_14, Count=10)  # -> Geometry, Transform
loft_13 = Loft(
    Curves=reparameterize(arrcurve_13.Geometry),
    Options={Adjust=False, Closed=False, LoftEnds=0, LoftSimp=0, LoftType=0, Rebuild=10, Refit=0.01})

item_16 = ListItem(List=arrcurve_13.Geometry, Index="9", Wrap=True)
arrcurve_14 = CurveArray(Geometry=item_16, Curve=pline_12, Count=10)  # -> Geometry, Transform
loft_14 = Loft(
    Curves=reparameterize(arrcurve_14.Geometry),
    Options={Adjust=False, Closed=False, LoftEnds=0, LoftSimp=0, LoftType=0, Rebuild=10, Refit=0.01})

merge_2 = Merge(Data1=loft, Data2=loft_5, Data3=loft_6, Data4=loft_7, Data5=loft_13, Data6=loft_14, Data7=loft_2)

pt_2 = Point(Point(0, 0, 0))
scale_2 = Scale(Geometry=merge_2, Center=pt_2, Factor=number_slider)  # -> Geometry, Transform
debrep_2 = DeconstructBrep(Brep=scale_2.Geometry)  # -> reparameterize(Faces), Edges, Vertices
item_17 = ListItem(List=debrep_2.Faces, Index="0", Wrap=True)
item_18 = ListItem(List=debrep_2.Faces, Index="1", Wrap=True)
item_19 = ListItem(List=debrep_2.Faces, Index="2", Wrap=True)
item_20 = ListItem(List=debrep_2.Faces, Index="3", Wrap=True)
sdivide_5 = DivideSurface(Surface=item_19, UCount="50", VCount="50")  # -> Points, Normals, Parameters
sdivide_6 = DivideSurface(Surface=item_20, UCount="50", VCount="50")  # -> Points, Normals, Parameters
sdivide_7 = DivideSurface(Surface=item_18, UCount="50", VCount="50")  # -> Points, Normals, Parameters
sdivide_8 = DivideSurface(Surface=item_17, UCount="50", VCount="50")  # -> Points, Normals, Parameters
curvature_5 = SurfaceCurvature(Surface=item_19, Point=sdivide_5.Parameters)  # -> Frame, Gaussian, Mean
curvature_6 = SurfaceCurvature(Surface=item_20, Point=sdivide_6.Parameters)  # -> Frame, Gaussian, Mean
curvature_7 = SurfaceCurvature(Surface=item_18, Point=sdivide_7.Parameters)  # -> Frame, Gaussian, Mean
curvature_8 = SurfaceCurvature(Surface=item_17, Point=sdivide_8.Parameters)  # -> Frame, Gaussian, Mean
gradient_5 = Gradient(
    LowerLimit="-1",
    UpperLimit="1",
    Parameter=curvature_5.Gaussian,
    stops=[0: RGB(255, 0, 0), 0.251: RGB(255, 255, 0), 0.492: RGB(0, 128, 0), 0.75: RGB(0, 255, 255), 1: RGB(0, 0, 255)])
gradient_6 = Gradient(
    LowerLimit="-1",
    UpperLimit="1",
    Parameter=curvature_6.Gaussian,
    stops=[0: RGB(255, 0, 0), 0.251: RGB(255, 255, 0), 0.492: RGB(0, 128, 0), 0.75: RGB(0, 255, 255), 1: RGB(0, 0, 255)])
gradient_7 = Gradient(
    LowerLimit="-1",
    UpperLimit="1",
    Parameter=curvature_7.Gaussian,
    stops=[0: RGB(255, 0, 0), 0.251: RGB(255, 255, 0), 0.492: RGB(0, 128, 0), 0.75: RGB(0, 255, 255), 1: RGB(0, 0, 255)])
gradient_8 = Gradient(
    LowerLimit="-1",
    UpperLimit="1",
    Parameter=curvature_8.Gaussian,
    stops=[0: RGB(255, 0, 0), 0.251: RGB(255, 255, 0), 0.492: RGB(0, 128, 0), 0.75: RGB(0, 255, 255), 1: RGB(0, 0, 255)])
panel_7 = Panel(curvature_5.Gaussian)
panel_8 = Panel(curvature_6.Gaussian)
panel_9 = Panel(curvature_7.Gaussian)
panel_10 = Panel(curvature_8.Gaussian)
preview_5 = CustomPreview(Geometry=sdivide_5.Points, Material=gradient_5)
preview_6 = CustomPreview(Geometry=sdivide_6.Points, Material=gradient_6)
preview_7 = CustomPreview(Geometry=sdivide_7.Points, Material=gradient_7)
preview_8 = CustomPreview(Geometry=sdivide_8.Points, Material=gradient_8)

cirk3rot = Brep(loft_6)
cirk1 = Brep(loft)
cirk2rot = Brep(loft_5)
cirk7rot = Brep(loft_8)
cirk8rot = Brep(loft_9)
cyl2 = Brep(loft_2)
cyl1 = Brep(loft_14)
cirk5 = Brep(loft_13)
cirk6 = Brep(loft_3)
cirk10 = Brep(loft_11)
cyl3 = Brep(loft_12)
cirk9rot = Brep(loft_10)
cyl4 = Brep(loft_4)
cirk4rot = Brep(loft_7)
cap = CapHoles(Brep=cirk4rot)
cap_2 = CapHoles(Brep=cirk9rot)
cap_3 = CapHoles(Brep=cyl3)
cap_4 = CapHoles(Brep=cyl2)
cap_5 = CapHoles(Brep=cirk2rot)
cap_6 = CapHoles(Brep=cirk7rot)
trim = TrimSolid(Shape=cirk8rot, Cutters=cap_4)
cap_7 = CapHoles(Brep=cyl1)
sunion = SolidUnion(Breps=cap_5)
sunion_2 = SolidUnion(Breps=cap)
sunion_3 = SolidUnion(Breps=cap_6)
trim_2 = TrimSolid(Shape=cirk3rot, Cutters=cap_3)
cap_8 = CapHoles(Brep=cirk7rot)
cap_9 = CapHoles(Brep=cirk2rot)
cap_10 = CapHoles(Brep=cyl4)
sunion_4 = SolidUnion(Breps=cap_2)
trim_3 = TrimSolid(Shape=cirk1, Cutters=cap_8)
debrep_3 = DeconstructBrep(Brep=cirk2rot)  # -> Faces, Edges, Vertices
trim_4 = TrimSolid(Shape=trim_2, Cutters=cap_10)
trim_5 = TrimSolid(Shape=trim, Cutters=cap_7)
bbx = BrepBrep(BrepA=sunion, BrepB=sunion_3)  # -> Curves, Points
trim_6 = TrimSolid(Shape=cirk7rot, Cutters=cap_9)
debrep_4 = DeconstructBrep(Brep=cirk4rot)  # -> Faces, Edges, Vertices
bbx_2 = BrepBrep(BrepA=sunion_2, BrepB=sunion_4)  # -> Curves, Points
item_21 = ListItem(List=debrep_3.Faces, Index=Slider(5, range=0..10), Wrap=True)
item_22 = ListItem(List=debrep_4.Faces, Index=Slider(5, range=0..10), Wrap=True)
merge_3 = Merge(Data1=trim_6, Data2=cirk9rot, Data3=cirk10, Data4=trim_5, Data5=cirk6, Data6=cyl3, Data7=cyl4)
pt_3 = Point(Point(0, 0, 0))
scale_3 = Scale(Geometry=merge_3, Center=pt_3, Factor=number_slider)  # -> Geometry, Transform
preview_9 = CustomPreview(Geometry=scale_3.Geometry, Material=ColourSwatch(SwatchColor=RGB(136, 202, 156)))

item_23 = ListItem(List=debrep_3.Faces, Index=Slider(2, range=0..10), Wrap=True)
item_24 = ListItem(List=debrep_3.Edges, Index="82", Wrap=True)
X_3 = UnitX(Factor=1)
project = ProjectCurve(Curve=bbx.Curves, Brep=item_23, Direction=X_3)
divide = DivideCurve(Curve=project, Count=Slider(100, range=0..100), Kinks=False)  # -> Points, Tangents, Parameters
end = EndPoints(Curve=project)  # -> Start, End
item_25 = ListItem(List=divide.Points, Index="0", Wrap=True)
item_26 = ListItem(List=divide.Points, Index="99", Wrap=True)
crv_cp = CurveClosestPoint(Point=item_26, Curve=item_24)  # -> Point, Parameter, Distance
crv_cp_2 = CurveClosestPoint(Point=end.Start, Curve=item_24)  # -> Point, Parameter, Distance
crv_cp_3 = CurveClosestPoint(Point=item_25, Curve=project)  # -> Point, Parameter, Distance
crv_cp_4 = CurveClosestPoint(Point=item_26, Curve=project)  # -> Point, Parameter, Distance
dom_5 = ConstructDomain(DomainStart=crv_cp_2.Parameter, DomainEnd=crv_cp.Parameter)
dom_6 = ConstructDomain(DomainStart=crv_cp_3.Parameter, DomainEnd=crv_cp_4.Parameter)
subcrv = SubCurve(BaseCurve=item_24, Domain=dom_5)
subcrv_2 = SubCurve(BaseCurve=project, Domain=dom_6)
join = JoinCurves(Curves=[subcrv_2, subcrv], Preserve=False)
srfsplit = SurfaceSplit(Surface=item_23, Curves=join)
area = Area(Geometry=srfsplit)  # -> Area, Centroid
pull = PullPoint(Point=area.Centroid, Geometry=srfsplit, ClosestOnly=True)  # -> ClosestPoint, Distance, Index
vec_41 = VectorXYZ(XComponent="0.1", YComponent="0.1", ZComponent="0.1")  # -> Vector, Length
item_27 = ListItem(List=pull.ClosestPoint, Index=0, Wrap=True)
move = Move(Geometry=item_27, Motion=vec_41.Vector)  # -> Geometry, Transform
item_28 = ListItem(List=pull.ClosestPoint, Index="1", Wrap=True)
pull_2 = PullPoint(Point=move.Geometry, Geometry=srfsplit, ClosestOnly=True)  # -> ClosestPoint, Distance, Index
merge_4 = Merge(Data1=item_28, Data2=pull_2.ClosestPoint)
incurve = PointInCurve(Point=merge_4, Curve=join)  # -> Relationship, Point
larger = LargerThan(FirstNumber=incurve.Relationship, SecondNumber="1")  # -> LargerThan, OrEqualTo
cull = CullPattern(List=srfsplit, CullPattern=larger.OrEqualTo)

item_29 = ListItem(List=debrep_3.Faces, Index=Slider(3, range=0..10), Wrap=True)
item_30 = ListItem(List=debrep_3.Edges, Index=Slider(4, range=0..100), Wrap=True)
item_31 = ListItem(List=debrep_3.Edges, Index=Slider(11, range=0..100), Wrap=True)
item_32 = ListItem(List=debrep_3.Edges, Index=Slider(10, range=0..100), Wrap=True)
project_2 = ProjectCurve(Curve=bbx.Curves, Brep=item_29, Direction=Vector(0, 0, 1))
divide_2 = DivideCurve(Curve=project_2, Count=Slider(100, range=0..100), Kinks=False)  # -> Points, Tangents, Parameters
divide_3 = DivideCurve(Curve=item_30, Count=Slider(100, range=0..100), Kinks=False)  # -> Points, Tangents, Parameters
divide_4 = DivideCurve(Curve=item_31, Count=Slider(100, range=0..100), Kinks=False)  # -> Points, Tangents, Parameters
divide_5 = DivideCurve(Curve=item_32, Count=Slider(502, range=0..1000), Kinks=False)  # -> Points, Tangents, Parameters
item_33 = ListItem(List=flatten(divide_2.Points), Index="527", Wrap=True)
item_34 = ListItem(List=flatten(divide_2.Points), Index="201", Wrap=True)
crv_cp_5 = CurveClosestPoint(Point=item_33, Curve=project_2)  # -> flatten(Point), flatten(Parameter), Distance
crv_cp_6 = CurveClosestPoint(Point=item_34, Curve=project_2)  # -> flatten(Point), flatten(Parameter), Distance
item_35 = ListItem(List=divide_4.Points, Index="-1", Wrap=True)
item_36 = ListItem(List=divide_5.Points, Index="-1", Wrap=True)
item_37 = ListItem(List=divide_5.Points, Index="410", Wrap=True)
item_38 = ListItem(List=divide_3.Points, Index="-1", Wrap=True)
item_39 = ListItem(List=divide_3.Points, Index="0", Wrap=True)
item_40 = ListItem(List=crv_cp_6.Parameter, Index="1", Wrap=True)
item_41 = ListItem(List=crv_cp_5.Parameter, Index="1", Wrap=True)
crv_cp_7 = CurveClosestPoint(Point=item_38, Curve=item_30)  # -> Point, Parameter, Distance
crv_cp_8 = CurveClosestPoint(Point=item_39, Curve=item_30)  # -> Point, Parameter, Distance
crv_cp_9 = CurveClosestPoint(Point=item_33, Curve=item_31)  # -> Point, Parameter, Distance
crv_cp_10 = CurveClosestPoint(Point=item_35, Curve=item_31)  # -> Point, Parameter, Distance
crv_cp_11 = CurveClosestPoint(Point=item_36, Curve=item_32)  # -> Point, Parameter, Distance
crv_cp_12 = CurveClosestPoint(Point=item_37, Curve=item_32)  # -> Point, Parameter, Distance
dom_7 = ConstructDomain(DomainStart=item_40, DomainEnd=item_41)
subcrv_3 = SubCurve(BaseCurve=project_2, Domain=flatten(dom_7))
dom_8 = ConstructDomain(DomainStart=crv_cp_7.Parameter, DomainEnd=crv_cp_8.Parameter)
dom_9 = ConstructDomain(DomainStart=crv_cp_10.Parameter, DomainEnd=crv_cp_9.Parameter)
dom_10 = ConstructDomain(DomainStart=crv_cp_12.Parameter, DomainEnd=crv_cp_11.Parameter)
subcrv_4 = SubCurve(BaseCurve=item_31, Domain=dom_9)
subcrv_5 = SubCurve(BaseCurve=item_30, Domain=dom_8)
subcrv_6 = SubCurve(BaseCurve=item_32, Domain=dom_10)
item_42 = ListItem(List=subcrv_3, Index="1", Wrap=True)
end_2 = EndPoints(Curve=item_42)  # -> Start, End
end_3 = EndPoints(Curve=subcrv_4)  # -> Start, End
ln = Line(StartPoint=end_2.Start, EndPoint=end_3.End)
join_2 = JoinCurves(Curves=[item_42, subcrv_5, subcrv_6, subcrv_4, ln], Preserve=False)
srfsplit_2 = SurfaceSplit(Surface=item_29, Curves=join_2)
clscrv = CloseCurve(Curve=join_2, CloseType=0, Bulge=0.5, Tolerance=0)  # -> Closed, R
area_2 = Area(Geometry=srfsplit_2)  # -> Area, Centroid
incurve_2 = PointInCurve(Point=area_2.Centroid, Curve=clscrv.Closed)  # -> Relationship, Point
larger_2 = LargerThan(FirstNumber=incurve_2.Relationship, SecondNumber="1")  # -> LargerThan, OrEqualTo
cull_2 = CullPattern(List=srfsplit_2, CullPattern=larger_2.LargerThan)

item_43 = ListItem(List=debrep_4.Faces, Index=Slider(3, range=0..10), Wrap=True)
item_44 = ListItem(List=debrep_4.Edges, Index=Slider(8, range=0..100), Wrap=True)
item_45 = ListItem(List=debrep_4.Edges, Index=Slider(11, range=0..100), Wrap=True)
item_46 = ListItem(List=debrep_4.Edges, Index=Slider(10, range=0..100), Wrap=True)
project_3 = ProjectCurve(Curve=bbx_2.Curves, Brep=item_43, Direction=Vector(0, 0, 1))
divide_6 = DivideCurve(Curve=project_3, Count=Slider(100, range=0..100), Kinks=False)  # -> Points, Tangents, Parameters
divide_7 = DivideCurve(Curve=item_44, Count=Slider(100, range=0..100), Kinks=False)  # -> Points, Tangents, Parameters
divide_8 = DivideCurve(Curve=item_45, Count=Slider(100, range=0..100), Kinks=False)  # -> Points, Tangents, Parameters
divide_9 = DivideCurve(Curve=item_46, Count=Slider(100, range=0..1000), Kinks=False)  # -> Points, Tangents, Parameters
item_47 = ListItem(List=flatten(divide_6.Points), Index="121", Wrap=True)
item_48 = ListItem(List=flatten(divide_6.Points), Index="201", Wrap=True)
crv_cp_13 = CurveClosestPoint(Point=item_47, Curve=project_3)  # -> flatten(Point), flatten(Parameter), Distance
crv_cp_14 = CurveClosestPoint(Point=item_48, Curve=project_3)  # -> flatten(Point), flatten(Parameter), Distance
item_49 = ListItem(List=divide_8.Points, Index="0", Wrap=True)
item_50 = ListItem(List=divide_9.Points, Index="0", Wrap=True)
item_51 = ListItem(List=divide_9.Points, Index="17", Wrap=True)
item_52 = ListItem(List=divide_7.Points, Index="-1", Wrap=True)
item_53 = ListItem(List=divide_7.Points, Index="0", Wrap=True)
item_54 = ListItem(List=crv_cp_14.Parameter, Index="1", Wrap=True)
item_55 = ListItem(List=crv_cp_13.Parameter, Index="1", Wrap=True)
crv_cp_15 = CurveClosestPoint(Point=item_52, Curve=item_44)  # -> Point, Parameter, Distance
crv_cp_16 = CurveClosestPoint(Point=item_53, Curve=item_44)  # -> Point, Parameter, Distance
crv_cp_17 = CurveClosestPoint(Point=item_47, Curve=item_45)  # -> Point, Parameter, Distance
crv_cp_18 = CurveClosestPoint(Point=item_49, Curve=item_45)  # -> Point, Parameter, Distance
crv_cp_19 = CurveClosestPoint(Point=item_50, Curve=item_46)  # -> Point, Parameter, Distance
crv_cp_20 = CurveClosestPoint(Point=item_51, Curve=item_46)  # -> Point, Parameter, Distance
dom_11 = ConstructDomain(DomainStart=item_54, DomainEnd=item_55)
subcrv_7 = SubCurve(BaseCurve=project_3, Domain=flatten(dom_11))
dom_12 = ConstructDomain(DomainStart=crv_cp_15.Parameter, DomainEnd=crv_cp_16.Parameter)
dom_13 = ConstructDomain(DomainStart=crv_cp_18.Parameter, DomainEnd=crv_cp_17.Parameter)
dom_14 = ConstructDomain(DomainStart=crv_cp_20.Parameter, DomainEnd=crv_cp_19.Parameter)
subcrv_8 = SubCurve(BaseCurve=item_45, Domain=dom_13)
subcrv_9 = SubCurve(BaseCurve=item_44, Domain=dom_12)
subcrv_10 = SubCurve(BaseCurve=item_46, Domain=dom_14)
item_56 = ListItem(List=subcrv_7, Index="1", Wrap=True)
end_4 = EndPoints(Curve=item_56)  # -> Start, End
end_5 = EndPoints(Curve=subcrv_8)  # -> Start, End
ln_2 = Line(StartPoint=end_4.Start, EndPoint=end_5.End)
join_3 = JoinCurves(Curves=[item_56, subcrv_9, subcrv_10, subcrv_8, ln_2], Preserve=False)
srfsplit_3 = SurfaceSplit(Surface=item_43, Curves=join_3)
clscrv_2 = CloseCurve(Curve=join_3, CloseType=0, Bulge=0.5, Tolerance=0)  # -> Closed, R
area_3 = Area(Geometry=srfsplit_3)  # -> Area, Centroid
incurve_3 = PointInCurve(Point=area_3.Centroid, Curve=clscrv_2.Closed)  # -> Relationship, Point
larger_3 = LargerThan(FirstNumber=incurve_3.Relationship, SecondNumber="1")  # -> LargerThan, OrEqualTo
cull_3 = CullPattern(List=srfsplit_3, CullPattern=larger_3.LargerThan)

item_57 = ListItem(List=debrep_3.Faces, Index=Slider(0, range=0..10), Wrap=True)
Y_3 = UnitY(Factor=1)
project_4 = ProjectCurve(Curve=bbx.Curves, Brep=item_57, Direction=Y_3)
end_6 = EndPoints(Curve=project_4)  # -> Start, End
ln_3 = Line(StartPoint=end_6.Start, EndPoint=end_6.End)
join_4 = JoinCurves(Curves=[ln_3, project_4], Preserve=False)
srfsplit_4 = SurfaceSplit(Surface=item_57, Curves=join_4)
area_4 = Area(Geometry=srfsplit_4)  # -> Area, Centroid
incurve_4 = PointInCurve(Point=area_4.Centroid, Curve=join_4)  # -> Relationship, Point
smaller = SmallerThan(FirstNumber=incurve_4.Relationship, SecondNumber="1")  # -> SmallerThan, OrEqualTo
cull_4 = CullPattern(List=srfsplit_4, CullPattern=smaller.SmallerThan)

item_58 = ListItem(List=debrep_4.Faces, Index=Slider(0, range=0..10), Wrap=True)
Y_4 = UnitY(Factor=1)
project_5 = ProjectCurve(Curve=bbx_2.Curves, Brep=item_58, Direction=Y_4)
end_7 = EndPoints(Curve=project_5)  # -> Start, End
ln_4 = Line(StartPoint=end_7.Start, EndPoint=end_7.End)
join_5 = JoinCurves(Curves=[ln_4, project_5], Preserve=False)
srfsplit_5 = SurfaceSplit(Surface=item_58, Curves=join_5)
area_5 = Area(Geometry=srfsplit_5)  # -> Area, Centroid
incurve_5 = PointInCurve(Point=area_5.Centroid, Curve=join_5)  # -> Relationship, Point
smaller_2 = SmallerThan(FirstNumber=incurve_5.Relationship, SecondNumber="1")  # -> SmallerThan, OrEqualTo
cull_5 = CullPattern(List=srfsplit_5, CullPattern=smaller_2.SmallerThan)

debrep_5 = DeconstructBrep(Brep=scale_3.Geometry)  # -> flatten(Faces), Edges, Vertices

item_59 = ListItem(List=debrep_5.Faces, Index=Slider(2, range=0..100), Wrap=True)
item_60 = ListItem(List=debrep_5.Faces, Index=Slider(52, range=0..100), Wrap=True)
item_61 = ListItem(List=debrep_5.Faces, Index=Slider(5, range=0..100), Wrap=True)
item_62 = ListItem(List=debrep_5.Faces, Index=Slider(0, range=0..100), Wrap=True)
item_63 = ListItem(List=debrep_5.Faces, Index=Slider(6, range=0..100), Wrap=True)
item_64 = ListItem(List=debrep_5.Faces, Index=Slider(7, range=0..100), Wrap=True)
item_65 = ListItem(List=debrep_5.Faces, Index=Slider(34, range=0..100), Wrap=True)
item_66 = ListItem(List=debrep_5.Faces, Index=Slider(9, range=0..100), Wrap=True)
item_67 = ListItem(List=debrep_5.Faces, Index=Slider(24, range=0..100), Wrap=True)
item_68 = ListItem(List=debrep_5.Faces, Index=Slider(11, range=0..100), Wrap=True)
item_69 = ListItem(List=debrep_5.Faces, Index=Slider(12, range=0..100), Wrap=True)
item_70 = ListItem(List=debrep_5.Faces, Index=Slider(20, range=0..100), Wrap=True)
item_71 = ListItem(List=debrep_5.Faces, Index=Slider(14, range=0..100), Wrap=True)
item_72 = ListItem(List=debrep_5.Faces, Index=Slider(21, range=0..100), Wrap=True)
item_73 = ListItem(List=debrep_5.Faces, Index=Slider(23, range=0..100), Wrap=True)
item_74 = ListItem(List=debrep_5.Faces, Index=Slider(25, range=0..100), Wrap=True)
item_75 = ListItem(List=debrep_5.Faces, Index=Slider(40, range=0..100), Wrap=True)
item_76 = ListItem(List=debrep_5.Faces, Index=Slider(38, range=0..100), Wrap=True)
merge_5 = Merge(
    Data1=item_62,
    Data2=item_59,
    Data3=item_60,
    Data4=item_61,
    Data5=item_63,
    Data6=item_64,
    Data7=item_65,
    Data8=item_66,
    Data9=item_67,
    Data10=item_68,
    Data11=item_69,
    Data12=item_70,
    Data13=item_71,
    Data14=item_72,
    Data15=item_73,
    Data16=item_74,
    Data17=item_75,
    Data18=item_76)

brep = Brep(merge_5)

item_77 = ListItem(List=debrep_4.Faces, Index=Slider(2, range=0..10), Wrap=True)
item_78 = ListItem(List=debrep_4.Edges, Index="82", Wrap=True)
X_4 = UnitX(Factor=1)
project_6 = ProjectCurve(Curve=bbx_2.Curves, Brep=item_77, Direction=X_4)
divide_10 = DivideCurve(Curve=project_6, Count=Slider(100, range=0..100), Kinks=False)  # -> Points, Tangents, Parameters
end_8 = EndPoints(Curve=project_6)  # -> Start, End
item_79 = ListItem(List=divide_10.Points, Index="0", Wrap=True)
item_80 = ListItem(List=divide_10.Points, Index="98", Wrap=True)
crv_cp_21 = CurveClosestPoint(Point=item_80, Curve=item_78)  # -> Point, Parameter, Distance
crv_cp_22 = CurveClosestPoint(Point=end_8.Start, Curve=item_78)  # -> Point, Parameter, Distance
crv_cp_23 = CurveClosestPoint(Point=item_79, Curve=project_6)  # -> Point, Parameter, Distance
crv_cp_24 = CurveClosestPoint(Point=item_80, Curve=project_6)  # -> Point, Parameter, Distance
dom_15 = ConstructDomain(DomainStart=crv_cp_22.Parameter, DomainEnd=crv_cp_21.Parameter)
dom_16 = ConstructDomain(DomainStart=crv_cp_23.Parameter, DomainEnd=crv_cp_24.Parameter)
subcrv_11 = SubCurve(BaseCurve=item_78, Domain=dom_15)
subcrv_12 = SubCurve(BaseCurve=project_6, Domain=dom_16)
join_6 = JoinCurves(Curves=[subcrv_12, subcrv_11], Preserve=False)
srfsplit_6 = SurfaceSplit(Surface=item_77, Curves=join_6)
area_6 = Area(Geometry=srfsplit_6)  # -> Area, Centroid
pull_3 = PullPoint(Point=area_6.Centroid, Geometry=srfsplit_6, ClosestOnly=True)  # -> ClosestPoint, Distance, Index
vec_42 = VectorXYZ(XComponent="0.1", YComponent="0.1", ZComponent="0.1")  # -> Vector, Length
item_81 = ListItem(List=pull_3.ClosestPoint, Index="1", Wrap=True)
move_2 = Move(Geometry=item_81, Motion=vec_42.Vector)  # -> Geometry, Transform
item_82 = ListItem(List=pull_3.ClosestPoint, Index=0, Wrap=True)
pull_4 = PullPoint(Point=move_2.Geometry, Geometry=srfsplit_6, ClosestOnly=True)  # -> ClosestPoint, Distance, Index
merge_6 = Merge(Data1=item_82, Data2=pull_4.ClosestPoint)
incurve_6 = PointInCurve(Point=merge_6, Curve=join_6)  # -> Relationship, Point

smaller_3 = SmallerThan(FirstNumber=incurve_6.Relationship, SecondNumber="1")  # -> SmallerThan, OrEqualTo
merge_7 = Merge(Data1=cull_4, Data2=cull, Data3=item_21, Data4=cull_2)

cull_6 = CullPattern(List=srfsplit_6, CullPattern=smaller_3.SmallerThan)

merge_8 = Merge(Data1=cull_5, Data2=cull_6, Data3=item_22, Data4=cull_3)
merge_9 = Merge(Data1=trim_3, Data2=merge_7, Data3=trim_4, Data4=merge_8, Data5=cyl2, Data6=cyl1, Data7=cirk5)
scale_4 = Scale(Geometry=merge_9, Center=pt_3, Factor=number_slider)  # -> Geometry, Transform
preview_10 = CustomPreview(Geometry=scale_4.Geometry, Material=ColourSwatch(SwatchColor=RGB(36, 59, 52)))

debrep_6 = DeconstructBrep(Brep=scale_4.Geometry)  # -> flatten(Faces), Edges, Vertices

item_83 = ListItem(List=debrep_5.Faces, Index=Slider(1, range=0..100), Wrap=True)
item_84 = ListItem(List=debrep_5.Faces, Index=Slider(3, range=0..100), Wrap=True)
item_85 = ListItem(List=debrep_5.Faces, Index=Slider(15, range=0..100), Wrap=True)
item_86 = ListItem(List=debrep_5.Faces, Index=Slider(16, range=0..100), Wrap=True)
item_87 = ListItem(List=debrep_5.Faces, Index=Slider(17, range=0..100), Wrap=True)
item_88 = ListItem(List=debrep_5.Faces, Index=Slider(18, range=0..100), Wrap=True)
item_89 = ListItem(List=debrep_5.Faces, Index=Slider(19, range=0..100), Wrap=True)
item_90 = ListItem(List=debrep_5.Faces, Index=Slider(43, range=0..100), Wrap=True)
item_91 = ListItem(List=debrep_5.Faces, Index=Slider(26, range=0..100), Wrap=True)
item_92 = ListItem(List=debrep_5.Faces, Index=Slider(27, range=0..100), Wrap=True)
item_93 = ListItem(List=debrep_5.Faces, Index=Slider(28, range=0..100), Wrap=True)
item_94 = ListItem(List=debrep_5.Faces, Index=Slider(29, range=0..100), Wrap=True)
item_95 = ListItem(List=debrep_6.Faces, Index=Slider(1, range=0..100), Wrap=True)
item_96 = ListItem(List=debrep_6.Faces, Index=Slider(3, range=0..100), Wrap=True)
item_97 = ListItem(List=debrep_6.Faces, Index=Slider(15, range=0..100), Wrap=True)
item_98 = ListItem(List=debrep_6.Faces, Index=Slider(16, range=0..100), Wrap=True)
item_99 = ListItem(List=debrep_6.Faces, Index=Slider(17, range=0..100), Wrap=True)
item_100 = ListItem(List=debrep_6.Faces, Index=Slider(18, range=0..100), Wrap=True)
item_101 = ListItem(List=debrep_6.Faces, Index=Slider(20, range=0..100), Wrap=True)
item_102 = ListItem(List=debrep_6.Faces, Index=Slider(19, range=0..100), Wrap=True)
item_103 = ListItem(List=debrep_6.Faces, Index=Slider(22, range=0..100), Wrap=True)
item_104 = ListItem(List=debrep_6.Faces, Index=Slider(24, range=0..100), Wrap=True)
item_105 = ListItem(List=debrep_6.Faces, Index=Slider(26, range=0..100), Wrap=True)
item_106 = ListItem(List=debrep_6.Faces, Index=Slider(27, range=0..100), Wrap=True)
item_107 = ListItem(List=debrep_6.Faces, Index=Slider(28, range=0..100), Wrap=True)
item_108 = ListItem(List=debrep_6.Faces, Index=Slider(29, range=0..100), Wrap=True)
merge_10 = Merge(
    Data2=item_83,
    Data3=item_84,
    Data4=item_85,
    Data5=item_86,
    Data6=item_87,
    Data7=item_88,
    Data9=item_89,
    Data11=item_90,
    Data12=item_91,
    Data13=item_92,
    Data14=item_93,
    Data15=item_94)
merge_11 = Merge(
    Data2=item_95,
    Data3=item_96,
    Data4=item_97,
    Data5=item_98,
    Data6=item_99,
    Data7=item_100,
    Data8=item_101,
    Data9=item_102,
    Data10=item_103,
    Data11=item_104,
    Data12=item_105,
    Data13=item_106,
    Data14=item_107,
    Data15=item_108)

item_109 = ListItem(List=debrep_6.Faces, Index=Slider(5, range=0..100), Wrap=True)
item_110 = ListItem(List=debrep_6.Faces, Index=Slider(2, range=0..100), Wrap=True)
item_111 = ListItem(List=debrep_6.Faces, Index=Slider(4, range=0..100), Wrap=True)
item_112 = ListItem(List=debrep_6.Faces, Index=Slider(0, range=0..100), Wrap=True)
item_113 = ListItem(List=debrep_6.Faces, Index=Slider(6, range=0..100), Wrap=True)
item_114 = ListItem(List=debrep_6.Faces, Index=Slider(7, range=0..100), Wrap=True)
item_115 = ListItem(List=debrep_6.Faces, Index=Slider(8, range=0..100), Wrap=True)
item_116 = ListItem(List=debrep_6.Faces, Index=Slider(9, range=0..100), Wrap=True)
item_117 = ListItem(List=debrep_6.Faces, Index=Slider(10, range=0..100), Wrap=True)
item_118 = ListItem(List=debrep_6.Faces, Index=Slider(11, range=0..100), Wrap=True)
item_119 = ListItem(List=debrep_6.Faces, Index=Slider(12, range=0..100), Wrap=True)
item_120 = ListItem(List=debrep_6.Faces, Index=Slider(13, range=0..100), Wrap=True)
item_121 = ListItem(List=debrep_6.Faces, Index=Slider(14, range=0..100), Wrap=True)
item_122 = ListItem(List=debrep_6.Faces, Index=Slider(21, range=0..100), Wrap=True)
item_123 = ListItem(List=debrep_6.Faces, Index=Slider(23, range=0..100), Wrap=True)
item_124 = ListItem(List=debrep_6.Faces, Index=Slider(25, range=0..100), Wrap=True)
merge_12 = Merge(
    Data1=item_112,
    Data2=item_110,
    Data3=item_111,
    Data4=item_109,
    Data5=item_113,
    Data6=item_114,
    Data7=item_115,
    Data8=item_116,
    Data9=item_117,
    Data10=item_118,
    Data11=item_119,
    Data12=item_120,
    Data13=item_121,
    Data14=item_122,
    Data15=item_123,
    Data16=item_124)

brep_2 = Brep(merge_10)
brep_3 = Brep(merge_11)
unroll = Unroll(MeshOrBrep=brep_3)  # -> Brep, Curves, Points, TextDotsLocation, TextDots
unroll_2 = Unroll(MeshOrBrep=brep_2)  # -> Brep, Curves, Points, TextDotsLocation, TextDots
debrep_7 = DeconstructBrep(Brep=unroll.Brep)  # -> Faces, Edges, Vertices
debrep_8 = DeconstructBrep(Brep=unroll_2.Brep)  # -> Faces, Edges, Vertices
area_7 = Area(Geometry=debrep_7.Faces)  # -> Area, Centroid
area_8 = Area(Geometry=debrep_8.Faces)  # -> Area, Centroid
sort = SortList(Keys=area_7.Area, ValuesA=debrep_7.Faces)  # -> Keys, ValuesA
sort_2 = SortList(Keys=area_8.Area, ValuesA=debrep_8.Faces)  # -> Keys, ValuesA
brep_4 = Brep(merge_12)

unroll_3 = Unroll(MeshOrBrep=brep)  # -> Brep, Curves, Points, TextDotsLocation, TextDots
debrep_9 = DeconstructBrep(Brep=unroll_3.Brep)  # -> Faces, Edges, Vertices
rectangle = Rectangle(Plane=PlaneXY(0, 0, 0), XSize=Slider(805, range=0..1000), YSize=Slider(440, range=0..1000), Radius=0)  # -> Rectangle, Length

area_9 = Area(Geometry=debrep_9.Faces)  # -> Area, Centroid

sort_3 = SortList(Keys=area_9.Area, ValuesA=debrep_9.Faces)  # -> Keys, ValuesA
merge_13 = Merge(Data4=sort_3.ValuesA)
planar = IsPlanar(Surface=merge_13, Interior=True)  # -> Planar, Plane
pack = PackObjects(Geo=merge_13, Plane=planar.Plane, X=1, Y=1, Tolerabce=0)  # -> Geo, Transformation
edges = BrepEdges(Brep=pack.Geo)  # -> Naked, Interior, NonManifold
join_7 = JoinCurves(Curves=edges.Naked, Preserve=False)

area_10 = Area(Geometry=join_7)  # -> Area, Centroid

sort_4 = SortList(Keys=area_10.Area, ValuesA=join_7)  # -> Keys, ValuesA
lastdex = LastIndex(List=sort_4.Keys)
item_125 = ListItem(List=sort_4.ValuesA, Index=lastdex, Wrap=True)  # -> flatten(Item)
cp = ControlPoints(Curve=item_125)  # -> Points, Weights, Knots
hull = ConvexHull(Points=cp.Points, Plane=PlaneXY(0, 0, 0))  # -> flatten(Hull), HullZ, Indices
opennest = OpenNest(
    Sheets=rectangle.Rectangle,
    Geo=hull.Hull,
    Spacing=Slider(3.09, range=0..10),
    Placement=1,
    Tolerance=0.1,
    Rotations=4,
    Iterations=1,
    Seed=1,
    Reset=True,
    Run=False)  # -> Sheets, Geo, ID, Transform, IDS
transform = Transform(Geometry=join_7, Transform=graft(opennest.Transform))
crv = Curve(flatten(transform))
crv_2 = Curve(opennest.Sheets)

merge_14 = Merge(Data1=sort.ValuesA, Data2=sort_2.ValuesA)
planar_2 = IsPlanar(Surface=merge_14, Interior=True)  # -> Planar, Plane
pack_2 = PackObjects(Geo=merge_14, Plane=planar_2.Plane, X=1, Y=1, Tolerabce=0)  # -> Geo, Transformation
edges_2 = BrepEdges(Brep=pack_2.Geo)  # -> Naked, Interior, NonManifold
join_8 = JoinCurves(Curves=edges_2.Naked, Preserve=False)
rectangle_2 = Rectangle(Plane=PlaneXY(0, 0, 0), XSize=Slider(805, range=0..1000), YSize=Slider(440, range=0..1000), Radius=0)  # -> Rectangle, Length

area_11 = Area(Geometry=join_8)  # -> Area, Centroid

sort_5 = SortList(Keys=area_11.Area, ValuesA=join_8)  # -> Keys, ValuesA
lastdex_2 = LastIndex(List=sort_5.Keys)
item_126 = ListItem(List=sort_5.ValuesA, Index=lastdex_2, Wrap=True)  # -> flatten(Item)
cp_2 = ControlPoints(Curve=item_126)  # -> Points, Weights, Knots
hull_2 = ConvexHull(Points=cp_2.Points, Plane=PlaneXY(0, 0, 0))  # -> flatten(Hull), HullZ, Indices
opennest_2 = OpenNest(
    Sheets=rectangle_2.Rectangle,
    Geo=hull_2.Hull,
    Spacing=Slider(3.09, range=0..10),
    Placement=1,
    Tolerance=0.1,
    Rotations=4,
    Iterations=1,
    Seed=1,
    Reset=True,
    Run=False)  # -> Sheets, Geo, ID, Transform, IDS
transform_2 = Transform(Geometry=join_8, Transform=graft(opennest_2.Transform))
crv_3 = Curve(flatten(transform_2))
crv_4 = Curve(opennest_2.Sheets)

unroll_4 = Unroll(MeshOrBrep=brep_4)  # -> Brep, Curves, Points, TextDotsLocation, TextDots
debrep_10 = DeconstructBrep(Brep=unroll_4.Brep)  # -> Faces, Edges, Vertices
rectangle_3 = Rectangle(Plane=PlaneXY(0, 0, 0), XSize=Slider(805, range=0..1000), YSize=Slider(440, range=0..1000), Radius=0)  # -> Rectangle, Length

area_12 = Area(Geometry=debrep_10.Faces)  # -> Area, Centroid

sort_6 = SortList(Keys=area_12.Area, ValuesA=debrep_10.Faces)  # -> Keys, ValuesA
merge_15 = Merge(Data1=sort_6.ValuesA)
planar_3 = IsPlanar(Surface=merge_15, Interior=True)  # -> Planar, Plane
pack_3 = PackObjects(Geo=merge_15, Plane=planar_3.Plane, X=1, Y=1, Tolerabce=0)  # -> Geo, Transformation
edges_3 = BrepEdges(Brep=pack_3.Geo)  # -> Naked, Interior, NonManifold
join_9 = JoinCurves(Curves=edges_3.Naked, Preserve=False)

area_13 = Area(Geometry=join_9)  # -> Area, Centroid

sort_7 = SortList(Keys=area_13.Area, ValuesA=join_9)  # -> Keys, ValuesA
lastdex_3 = LastIndex(List=sort_7.Keys)
item_127 = ListItem(List=sort_7.ValuesA, Index=lastdex_3, Wrap=True)  # -> flatten(Item)
cp_3 = ControlPoints(Curve=item_127)  # -> Points, Weights, Knots
hull_3 = ConvexHull(Points=cp_3.Points, Plane=PlaneXY(0, 0, 0))  # -> flatten(Hull), HullZ, Indices
opennest_3 = OpenNest(
    Sheets=rectangle_3.Rectangle,
    Geo=hull_3.Hull,
    Spacing=Slider(3.09, range=0..10),
    Placement=1,
    Tolerance=0.1,
    Rotations=4,
    Iterations=1,
    Seed=1,
    Reset=True,
    Run=False)  # -> Sheets, Geo, ID, Transform, IDS
transform_3 = Transform(Geometry=join_9, Transform=graft(opennest_3.Transform))
crv_5 = Curve(flatten(transform_3))
crv_6 = Curve(opennest_3.Sheets)

item_128 = ListItem(List=crv_5, Index=Slider(5, range=0..100), Wrap=True)
item_129 = ListItem(List=crv_5, Index=Slider(2, range=0..100), Wrap=True)
item_130 = ListItem(List=crv_5, Index=Slider(4, range=0..100), Wrap=True)
item_131 = ListItem(List=crv_5, Index=Slider(0, range=0..100), Wrap=True)
item_132 = ListItem(List=crv_5, Index=Slider(6, range=0..100), Wrap=True)
item_133 = ListItem(List=crv_5, Index=Slider(7, range=0..100), Wrap=True)
item_134 = ListItem(List=crv_5, Index=Slider(8, range=0..100), Wrap=True)
item_135 = ListItem(List=crv_5, Index=Slider(10, range=0..100), Wrap=True)
item_136 = ListItem(List=crv_5, Index=Slider(11, range=0..100), Wrap=True)
item_137 = ListItem(List=crv_5, Index=Slider(12, range=0..100), Wrap=True)
item_138 = ListItem(List=crv_5, Index=Slider(13, range=0..100), Wrap=True)
item_139 = ListItem(List=crv_5, Index=Slider(14, range=0..100), Wrap=True)
item_140 = ListItem(List=crv_5, Index=Slider(65, range=0..100), Wrap=True)
item_141 = ListItem(List=crv_5, Index=Slider(19, range=0..100), Wrap=True)
item_142 = ListItem(List=crv_5, Index=Slider(31, range=0..100), Wrap=True)
item_143 = ListItem(List=crv_5, Index=Slider(9, range=0..100), Wrap=True)
Y_5 = UnitY(Factor=1)
Y_6 = UnitY(Factor=1)
X_5 = UnitX(Factor=1)
Y_7 = UnitY(Factor=1)
Y_8 = UnitY(Factor=1)
Y_9 = UnitY(Factor=1)
Y_10 = UnitY(Factor=1)
vec_43 = VectorXYZ(XComponent=0, YComponent=Slider(4, range=-10..10), ZComponent=0)  # -> Vector, Length
vec_44 = VectorXYZ(XComponent=0, YComponent=Slider(3, range=-10..10), ZComponent=0)  # -> Vector, Length
vec_45 = VectorXYZ(XComponent=0, YComponent=Slider(3, range=-10..10), ZComponent=0)  # -> Vector, Length
vec_46 = VectorXYZ(XComponent=0, YComponent=Slider(3, range=-10..10), ZComponent=0)  # -> Vector, Length
vec_47 = VectorXYZ(XComponent=0, YComponent=Slider(-3, range=-10..10), ZComponent=0)  # -> Vector, Length

brep_5 = Brep(item_142)
debrep_11 = DeconstructBrep(Brep=brep_5)  # -> Faces, Edges, Vertices
number_slider_2 = Slider(13, range=0..100)
number_slider_3 = Slider(30, range=0..100)
divide_11 = DivideDomain²(Domain=debrep_11.Faces, UCount=number_slider_3, VCount=number_slider_2)
subsrf = Isotrim(Surface=debrep_11.Faces, Domain=divide_11)
area_14 = Area(Geometry=subsrf)  # -> Area, Centroid
Y_11 = UnitY(Factor=1)
line = LineSDL(Start=area_14.Centroid, Direction=Y_11, Length=Slider(8, range=0..10))
lng = ListLength(List=line)
series = Series(Start=0, Step=1, Count=lng)
vec_48 = VectorXYZ(XComponent=number_slider_3, YComponent=number_slider_2, ZComponent=0)  # -> Vector, Length
evalsrf = EvaluateSurface(Surface=debrep_11.Faces, Point=vec_48.Vector)  # -> Point, Normal, UDirection, VDirection, Frame
mod = Modulus(A=series, B="2")
equals = Equality(FirstNumber=mod, SecondNumber="0")  # -> Equality, Inequality
cull_7 = CullPattern(List=line, CullPattern=equals.Inequality)
extr = Extrude(Base=debrep_11.Faces, Direction=evalsrf.Normal)
vec_49 = VectorXYZ(XComponent=0, YComponent=Slider(3, range=-10..10), ZComponent=0)  # -> Vector, Length
move_3 = Move(Geometry=extr, Motion=vec_49.Vector)  # -> Geometry, Transform
trim_7 = TrimWithBrep(Curve=cull_7, Brep=move_3.Geometry)  # -> Inside, Outside
divide_12 = DivideCurve(Curve=cull_7, Count=10, Kinks=False)  # -> flatten(Points), Tangents, Parameters
end_9 = EndPoints(Curve=cull_7)  # -> Start, End
vec_50 = VectorXYZ(XComponent=0, YComponent=Slider(-2, range=-10..10), ZComponent=0)  # -> Vector, Length
move_4 = Move(Geometry=extr, Motion=vec_50.Vector)  # -> Geometry, Transform
trim_8 = TrimWithBrep(Curve=trim_7.Inside, Brep=move_4.Geometry)  # -> Inside, Outside
item_144 = ListItem(List=divide_12.Points, Index=Slider(10, range=0..100), Wrap=True)
item_145 = ListItem(List=divide_12.Points, Index=Slider(223, range=0..1000), Wrap=True)
item_146 = ListItem(List=end_9.End, Index=Slider(6, range=0..100), Wrap=True)
item_147 = ListItem(List=end_9.Start, Index=Slider(45, range=0..1000), Wrap=item_146)
crv_7 = Curve(trim_8.Inside)
dist = Distance(PointA=item_144, PointB=item_145)
dist_2 = Distance(PointA=item_147, PointB=item_146)
panel_11 = Panel(dist_2)
panel_12 = Panel(dist)

brep_6 = Brep(item_141)
debrep_12 = DeconstructBrep(Brep=brep_6)  # -> Faces, Edges, Vertices
number_slider_4 = Slider(13, range=0..100)
number_slider_5 = Slider(10, range=0..100)
divide_13 = DivideDomain²(Domain=debrep_12.Faces, UCount=number_slider_5, VCount=number_slider_4)
subsrf_2 = Isotrim(Surface=debrep_12.Faces, Domain=divide_13)
area_15 = Area(Geometry=subsrf_2)  # -> Area, Centroid
Y_12 = UnitY(Factor=1)
vec_51 = VectorXYZ(XComponent=number_slider_5, YComponent=number_slider_4, ZComponent=0)  # -> Vector, Length
evalsrf_2 = EvaluateSurface(Surface=debrep_12.Faces, Point=vec_51.Vector)  # -> Point, Normal, UDirection, VDirection, Frame
line_2 = LineSDL(Start=area_15.Centroid, Direction=evalsrf_2.UDirection, Length=Slider(8, range=0..10))
lng_2 = ListLength(List=line_2)
series_2 = Series(Start=0, Step=1, Count=lng_2)
mod_2 = Modulus(A=series_2, B="2")
equals_2 = Equality(FirstNumber=mod_2, SecondNumber="0")  # -> Equality, Inequality
cull_8 = CullPattern(List=line_2, CullPattern=equals_2.Inequality)
extr_2 = Extrude(Base=debrep_12.Faces, Direction=evalsrf_2.Normal)
vec_52 = VectorXYZ(XComponent=Slider(3, range=-10..10), YComponent=0, ZComponent=0)  # -> Vector, Length
move_5 = Move(Geometry=extr_2, Motion=vec_52.Vector)  # -> Geometry, Transform
vec_53 = VectorXYZ(XComponent=Slider(-3, range=-10..10), YComponent=0, ZComponent=0)  # -> Vector, Length
trim_9 = TrimWithBrep(Curve=cull_8, Brep=move_5.Geometry)  # -> Inside, Outside
divide_14 = DivideCurve(Curve=cull_8, Count=10, Kinks=False)  # -> flatten(Points), Tangents, Parameters
end_10 = EndPoints(Curve=cull_8)  # -> Start, End
move_6 = Move(Geometry=extr_2, Motion=vec_53.Vector)  # -> Geometry, Transform
trim_10 = TrimWithBrep(Curve=trim_9.Inside, Brep=move_6.Geometry)  # -> Inside, Outside
crv_8 = Curve(trim_10.Inside)
item_148 = ListItem(List=divide_14.Points, Index=Slider(10, range=0..100), Wrap=True)
item_149 = ListItem(List=divide_14.Points, Index=Slider(223, range=0..1000), Wrap=True)
item_150 = ListItem(List=end_10.End, Index=Slider(6, range=0..100), Wrap=True)
item_151 = ListItem(List=end_10.Start, Index=Slider(45, range=0..1000), Wrap=item_150)
dist_3 = Distance(PointA=item_148, PointB=item_149)
dist_4 = Distance(PointA=item_151, PointB=item_150)
panel_13 = Panel(dist_4)
panel_14 = Panel(dist_3)

brep_7 = Brep(item_137)
debrep_13 = DeconstructBrep(Brep=brep_7)  # -> Faces, Edges, Vertices
number_slider_6 = Slider(13, range=0..100)
number_slider_7 = Slider(10, range=0..100)
divide_15 = DivideDomain²(Domain=debrep_13.Faces, UCount=number_slider_7, VCount=number_slider_6)
subsrf_3 = Isotrim(Surface=debrep_13.Faces, Domain=divide_15)
area_16 = Area(Geometry=subsrf_3)  # -> Area, Centroid
Y_13 = UnitY(Factor=1)
vec_54 = VectorXYZ(XComponent=number_slider_7, YComponent=number_slider_6, ZComponent=0)  # -> Vector, Length
evalsrf_3 = EvaluateSurface(Surface=debrep_13.Faces, Point=vec_54.Vector)  # -> Point, Normal, UDirection, VDirection, Frame
line_3 = LineSDL(Start=area_16.Centroid, Direction=evalsrf_3.UDirection, Length=Slider(8, range=0..10))
lng_3 = ListLength(List=line_3)
series_3 = Series(Start=0, Step=1, Count=lng_3)
mod_3 = Modulus(A=series_3, B="2")
equals_3 = Equality(FirstNumber=mod_3, SecondNumber="0")  # -> Equality, Inequality
cull_9 = CullPattern(List=line_3, CullPattern=equals_3.Inequality)
extr_3 = Extrude(Base=debrep_13.Faces, Direction=evalsrf_3.Normal)
vec_55 = VectorXYZ(XComponent=Slider(-2, range=-10..10), YComponent=0, ZComponent=0)  # -> Vector, Length
move_7 = Move(Geometry=extr_3, Motion=vec_55.Vector)  # -> Geometry, Transform
vec_56 = VectorXYZ(XComponent=Slider(2, range=-10..10), YComponent=0, ZComponent=0)  # -> Vector, Length
trim_11 = TrimWithBrep(Curve=cull_9, Brep=move_7.Geometry)  # -> Inside, Outside
divide_16 = DivideCurve(Curve=cull_9, Count=10, Kinks=False)  # -> flatten(Points), Tangents, Parameters
end_11 = EndPoints(Curve=cull_9)  # -> Start, End
move_8 = Move(Geometry=extr_3, Motion=vec_56.Vector)  # -> Geometry, Transform
trim_12 = TrimWithBrep(Curve=trim_11.Inside, Brep=move_8.Geometry)  # -> Inside, Outside
crv_9 = Curve(trim_12.Inside)
item_152 = ListItem(List=divide_16.Points, Index=Slider(10, range=0..100), Wrap=True)
item_153 = ListItem(List=divide_16.Points, Index=Slider(223, range=0..1000), Wrap=True)
item_154 = ListItem(List=end_11.End, Index=Slider(6, range=0..100), Wrap=True)
item_155 = ListItem(List=end_11.Start, Index=Slider(45, range=0..1000), Wrap=item_154)
dist_5 = Distance(PointA=item_152, PointB=item_153)
dist_6 = Distance(PointA=item_155, PointB=item_154)
panel_15 = Panel(dist_6)
panel_16 = Panel(dist_5)

brep_8 = Brep(item_138)
debrep_14 = DeconstructBrep(Brep=brep_8)  # -> Faces, Edges, Vertices
number_slider_8 = Slider(9, range=0..100)
number_slider_9 = Slider(41, range=0..100)
divide_17 = DivideDomain²(Domain=debrep_14.Faces, UCount=number_slider_8, VCount=number_slider_9)
subsrf_4 = Isotrim(Surface=debrep_14.Faces, Domain=divide_17)
area_17 = Area(Geometry=subsrf_4)  # -> Area, Centroid
X_6 = UnitX(Factor=1)
line_4 = LineSDL(Start=area_17.Centroid, Direction=X_6, Length=Slider(8, range=0..10))
lng_4 = ListLength(List=line_4)
series_4 = Series(Start=0, Step=1, Count=lng_4)
vec_57 = VectorXYZ(XComponent=number_slider_8, YComponent=number_slider_9, ZComponent=0)  # -> Vector, Length
evalsrf_4 = EvaluateSurface(Surface=debrep_14.Faces, Point=vec_57.Vector)  # -> Point, Normal, UDirection, VDirection, Frame
mod_4 = Modulus(A=series_4, B="2")
equals_4 = Equality(FirstNumber=mod_4, SecondNumber="0")  # -> Equality, Inequality
cull_10 = CullPattern(List=line_4, CullPattern=equals_4.Inequality)
divide_18 = DivideCurve(Curve=cull_10, Count=10, Kinks=False)  # -> flatten(Points), Tangents, Parameters
end_12 = EndPoints(Curve=cull_10)  # -> Start, End
extr_4 = Extrude(Base=debrep_14.Faces, Direction=evalsrf_4.Normal)
vec_58 = VectorXYZ(XComponent=Slider(-3, range=-10..10), YComponent=0, ZComponent=0)  # -> Vector, Length
move_9 = Move(Geometry=extr_4, Motion=vec_58.Vector)  # -> Geometry, Transform
trim_13 = TrimWithBrep(Curve=cull_10, Brep=move_9.Geometry)  # -> Inside, Outside
vec_59 = VectorXYZ(XComponent=Slider(2, range=-10..10), YComponent=0, ZComponent=0)  # -> Vector, Length
move_10 = Move(Geometry=extr_4, Motion=vec_59.Vector)  # -> Geometry, Transform
trim_14 = TrimWithBrep(Curve=trim_13.Inside, Brep=move_10.Geometry)  # -> Inside, Outside
item_156 = ListItem(List=divide_18.Points, Index=Slider(516, range=0..1000), Wrap=True)
item_157 = ListItem(List=divide_18.Points, Index=Slider(279, range=0..1000), Wrap=True)
item_158 = ListItem(List=end_12.End, Index=Slider(36, range=0..1000), Wrap=True)
item_159 = ListItem(List=end_12.Start, Index=Slider(65, range=0..1000), Wrap=item_158)
crv_10 = Curve(trim_14.Inside)
dist_7 = Distance(PointA=item_156, PointB=item_157)
dist_8 = Distance(PointA=item_159, PointB=item_158)
panel_17 = Panel(dist_7)
panel_18 = Panel(dist_8)

brep_9 = Brep(item_140)
debrep_15 = DeconstructBrep(Brep=brep_9)  # -> Faces, Edges, Vertices
number_slider_10 = Slider(7, range=0..100)
number_slider_11 = Slider(13, range=0..100)
divide_19 = DivideDomain²(Domain=debrep_15.Faces, UCount=number_slider_11, VCount=number_slider_10)
subsrf_5 = Isotrim(Surface=debrep_15.Faces, Domain=divide_19)
area_18 = Area(Geometry=subsrf_5)  # -> Area, Centroid
Y_14 = UnitY(Factor=1)
line_5 = LineSDL(Start=area_18.Centroid, Direction=Y_14, Length=Slider(8, range=0..10))
lng_5 = ListLength(List=line_5)
series_5 = Series(Start=0, Step=1, Count=lng_5)
vec_60 = VectorXYZ(XComponent=number_slider_11, YComponent=number_slider_10, ZComponent=0)  # -> Vector, Length
evalsrf_5 = EvaluateSurface(Surface=debrep_15.Faces, Point=vec_60.Vector)  # -> Point, Normal, UDirection, VDirection, Frame
mod_5 = Modulus(A=series_5, B="2")
equals_5 = Equality(FirstNumber=mod_5, SecondNumber="0")  # -> Equality, Inequality
cull_11 = CullPattern(List=line_5, CullPattern=equals_5.Inequality)
extr_5 = Extrude(Base=debrep_15.Faces, Direction=evalsrf_5.Normal)
vec_61 = VectorXYZ(XComponent=0, YComponent=Slider(-2, range=-10..10), ZComponent=0)  # -> Vector, Length
move_11 = Move(Geometry=extr_5, Motion=vec_61.Vector)  # -> Geometry, Transform
trim_15 = TrimWithBrep(Curve=cull_11, Brep=move_11.Geometry)  # -> Inside, Outside
divide_20 = DivideCurve(Curve=cull_11, Count=10, Kinks=False)  # -> flatten(Points), Tangents, Parameters
end_13 = EndPoints(Curve=cull_11)  # -> Start, End
vec_62 = VectorXYZ(XComponent=0, YComponent=Slider(3, range=-10..10), ZComponent=0)  # -> Vector, Length
move_12 = Move(Geometry=extr_5, Motion=vec_62.Vector)  # -> Geometry, Transform
trim_16 = TrimWithBrep(Curve=trim_15.Inside, Brep=move_12.Geometry)  # -> Inside, Outside
crv_11 = Curve(trim_16.Inside)
item_160 = ListItem(List=divide_20.Points, Index=Slider(760, range=0..1000), Wrap=True)
item_161 = ListItem(List=divide_20.Points, Index=Slider(623, range=0..1000), Wrap=True)
item_162 = ListItem(List=end_13.End, Index=Slider(80, range=0..100), Wrap=True)
item_163 = ListItem(List=end_13.Start, Index=Slider(103, range=0..1000), Wrap=item_162)
dist_9 = Distance(PointA=item_160, PointB=item_161)
dist_10 = Distance(PointA=item_163, PointB=item_162)
panel_19 = Panel(dist_10)
panel_20 = Panel(dist_9)

brep_10 = Brep(item_139)
debrep_16 = DeconstructBrep(Brep=brep_10)  # -> Faces, Edges, Vertices
number_slider_12 = Slider(11, range=0..100)
number_slider_13 = Slider(8, range=0..100)
divide_21 = DivideDomain²(Domain=debrep_16.Faces, UCount=number_slider_13, VCount=number_slider_12)
subsrf_6 = Isotrim(Surface=debrep_16.Faces, Domain=divide_21)
area_19 = Area(Geometry=subsrf_6)  # -> Area, Centroid
Y_15 = UnitY(Factor=1)
line_6 = LineSDL(Start=area_19.Centroid, Direction=Y_15, Length=Slider(8, range=0..10))
lng_6 = ListLength(List=line_6)
series_6 = Series(Start=0, Step=1, Count=lng_6)
vec_63 = VectorXYZ(XComponent=number_slider_13, YComponent=number_slider_12, ZComponent=0)  # -> Vector, Length
evalsrf_6 = EvaluateSurface(Surface=debrep_16.Faces, Point=vec_63.Vector)  # -> Point, Normal, UDirection, VDirection, Frame
mod_6 = Modulus(A=series_6, B="2")
equals_6 = Equality(FirstNumber=mod_6, SecondNumber="0")  # -> Equality, Inequality
cull_12 = CullPattern(List=line_6, CullPattern=equals_6.Inequality)
extr_6 = Extrude(Base=debrep_16.Faces, Direction=evalsrf_6.Normal)
vec_64 = VectorXYZ(XComponent=0, YComponent=Slider(2, range=-10..10), ZComponent=0)  # -> Vector, Length
divide_22 = DivideCurve(Curve=cull_12, Count=10, Kinks=False)  # -> flatten(Points), Tangents, Parameters
end_14 = EndPoints(Curve=cull_12)  # -> Start, End
move_13 = Move(Geometry=extr_6, Motion=vec_64.Vector)  # -> Geometry, Transform
trim_17 = TrimWithBrep(Curve=cull_12, Brep=move_13.Geometry)  # -> Inside, Outside
vec_65 = VectorXYZ(XComponent=0, YComponent=Slider(-2, range=-10..10), ZComponent=0)  # -> Vector, Length
move_14 = Move(Geometry=extr_6, Motion=vec_65.Vector)  # -> Geometry, Transform
trim_18 = TrimWithBrep(Curve=trim_17.Inside, Brep=move_14.Geometry)  # -> Inside, Outside
crv_12 = Curve(trim_18.Inside)
item_164 = ListItem(List=divide_22.Points, Index=Slider(156, range=0..1000), Wrap=True)
item_165 = ListItem(List=divide_22.Points, Index=Slider(305, range=0..1000), Wrap=True)
item_166 = ListItem(List=end_14.End, Index=Slider(86, range=0..1000), Wrap=True)
item_167 = ListItem(List=end_14.Start, Index=Slider(652, range=0..1000), Wrap=item_166)
dist_11 = Distance(PointA=item_164, PointB=item_165)
dist_12 = Distance(PointA=item_167, PointB=item_166)
panel_21 = Panel(dist_11)
panel_22 = Panel(dist_12)

brep_11 = Brep(item_136)
debrep_17 = DeconstructBrep(Brep=brep_11)  # -> Faces, Edges, Vertices
number_slider_14 = Slider(21, range=0..100)
number_slider_15 = Slider(19, range=0..100)
divide_23 = DivideDomain²(Domain=debrep_17.Faces, UCount=number_slider_15, VCount=number_slider_14)
subsrf_7 = Isotrim(Surface=debrep_17.Faces, Domain=divide_23)
area_20 = Area(Geometry=subsrf_7)  # -> Area, Centroid
X_7 = UnitX(Factor=1)
line_7 = LineSDL(Start=area_20.Centroid, Direction=X_7, Length=Slider(8, range=0..10))
lng_7 = ListLength(List=line_7)
series_7 = Series(Start=0, Step=1, Count=lng_7)
vec_66 = VectorXYZ(XComponent=number_slider_15, YComponent=number_slider_14, ZComponent=0)  # -> Vector, Length
evalsrf_7 = EvaluateSurface(Surface=debrep_17.Faces, Point=vec_66.Vector)  # -> Point, Normal, UDirection, VDirection, Frame
mod_7 = Modulus(A=series_7, B="2")
equals_7 = Equality(FirstNumber=mod_7, SecondNumber="0")  # -> Equality, Inequality
cull_13 = CullPattern(List=line_7, CullPattern=equals_7.Inequality)
extr_7 = Extrude(Base=debrep_17.Faces, Direction=evalsrf_7.Normal)
vec_67 = VectorXYZ(XComponent=0, YComponent=Slider(-3, range=-10..10), ZComponent=0)  # -> Vector, Length
move_15 = Move(Geometry=extr_7, Motion=vec_67.Vector)  # -> Geometry, Transform
trim_19 = TrimWithBrep(Curve=cull_13, Brep=move_15.Geometry)  # -> Inside, Outside
divide_24 = DivideCurve(Curve=cull_13, Count=10, Kinks=False)  # -> flatten(Points), Tangents, Parameters
end_15 = EndPoints(Curve=cull_13)  # -> Start, End
vec_68 = VectorXYZ(XComponent=0, YComponent=Slider(1, range=-10..10), ZComponent=0)  # -> Vector, Length
move_16 = Move(Geometry=extr_7, Motion=vec_68.Vector)  # -> Geometry, Transform
trim_20 = TrimWithBrep(Curve=trim_19.Inside, Brep=move_16.Geometry)  # -> Inside, Outside
crv_13 = Curve(trim_20.Inside)
item_168 = ListItem(List=divide_24.Points, Index=Slider(760, range=0..1000), Wrap=True)
item_169 = ListItem(List=divide_24.Points, Index=Slider(623, range=0..1000), Wrap=True)
item_170 = ListItem(List=end_15.End, Index=Slider(80, range=0..100), Wrap=True)
item_171 = ListItem(List=end_15.Start, Index=Slider(103, range=0..1000), Wrap=item_170)
dist_13 = Distance(PointA=item_168, PointB=item_169)
dist_14 = Distance(PointA=item_171, PointB=item_170)
panel_23 = Panel(dist_13)
panel_24 = Panel(dist_14)

brep_12 = Brep(item_135)
debrep_18 = DeconstructBrep(Brep=brep_12)  # -> Faces, Edges, Vertices
number_slider_16 = Slider(47, range=0..100)
number_slider_17 = Slider(12, range=0..100)
divide_25 = DivideDomain²(Domain=debrep_18.Faces, UCount=number_slider_17, VCount=number_slider_16)
subsrf_8 = Isotrim(Surface=debrep_18.Faces, Domain=divide_25)
area_21 = Area(Geometry=subsrf_8)  # -> Area, Centroid
X_8 = UnitX(Factor=1)
line_8 = LineSDL(Start=area_21.Centroid, Direction=X_8, Length=Slider(8, range=0..10))
lng_8 = ListLength(List=line_8)
series_8 = Series(Start=0, Step=1, Count=lng_8)
vec_69 = VectorXYZ(XComponent=number_slider_17, YComponent=number_slider_16, ZComponent=0)  # -> Vector, Length
evalsrf_8 = EvaluateSurface(Surface=debrep_18.Faces, Point=vec_69.Vector)  # -> Point, Normal, UDirection, VDirection, Frame
mod_8 = Modulus(A=series_8, B="2")
equals_8 = Equality(FirstNumber=mod_8, SecondNumber="0")  # -> Equality, Inequality
cull_14 = CullPattern(List=line_8, CullPattern=equals_8.Inequality)
extr_8 = Extrude(Base=debrep_18.Faces, Direction=evalsrf_8.Normal)
vec_70 = VectorXYZ(XComponent=0, YComponent=Slider(3, range=-10..10), ZComponent=0)  # -> Vector, Length
divide_26 = DivideCurve(Curve=cull_14, Count=10, Kinks=False)  # -> flatten(Points), Tangents, Parameters
end_16 = EndPoints(Curve=cull_14)  # -> Start, End
move_17 = Move(Geometry=extr_8, Motion=vec_70.Vector)  # -> Geometry, Transform
trim_21 = TrimWithBrep(Curve=cull_14, Brep=move_17.Geometry)  # -> Inside, Outside
vec_71 = VectorXYZ(XComponent=0, YComponent=Slider(-2, range=-10..10), ZComponent=0)  # -> Vector, Length
move_18 = Move(Geometry=extr_8, Motion=vec_71.Vector)  # -> Geometry, Transform
trim_22 = TrimWithBrep(Curve=trim_21.Inside, Brep=move_18.Geometry)  # -> Inside, Outside
crv_14 = Curve(trim_22.Inside)
item_172 = ListItem(List=divide_26.Points, Index=Slider(156, range=0..1000), Wrap=True)
item_173 = ListItem(List=divide_26.Points, Index=Slider(305, range=0..1000), Wrap=True)
item_174 = ListItem(List=end_16.End, Index=Slider(86, range=0..1000), Wrap=True)
item_175 = ListItem(List=end_16.Start, Index=Slider(652, range=0..1000), Wrap=item_174)
dist_15 = Distance(PointA=item_172, PointB=item_173)
dist_16 = Distance(PointA=item_175, PointB=item_174)
panel_25 = Panel(dist_16)
panel_26 = Panel(dist_15)

brep_13 = Brep(item_131)
debrep_19 = DeconstructBrep(Brep=brep_13)  # -> Faces, Edges, Vertices
number_slider_18 = Slider(41, range=0..100)
number_slider_19 = Slider(9, range=0..100)
divide_27 = DivideDomain²(Domain=debrep_19.Faces, UCount=number_slider_19, VCount=number_slider_18)
subsrf_9 = Isotrim(Surface=debrep_19.Faces, Domain=divide_27)
area_22 = Area(Geometry=subsrf_9)  # -> Area, Centroid
X_9 = UnitX(Factor=1)
line_9 = LineSDL(Start=area_22.Centroid, Direction=X_9, Length=Slider(8, range=0..10))
lng_9 = ListLength(List=line_9)
series_9 = Series(Start=0, Step=1, Count=lng_9)
vec_72 = VectorXYZ(XComponent=number_slider_19, YComponent=number_slider_18, ZComponent=0)  # -> Vector, Length
evalsrf_9 = EvaluateSurface(Surface=debrep_19.Faces, Point=vec_72.Vector)  # -> Point, Normal, UDirection, VDirection, Frame
mod_9 = Modulus(A=series_9, B="2")
equals_9 = Equality(FirstNumber=mod_9, SecondNumber="0")  # -> Equality, Inequality
cull_15 = CullPattern(List=line_9, CullPattern=equals_9.Inequality)
extr_9 = Extrude(Base=debrep_19.Faces, Direction=evalsrf_9.Normal)
vec_73 = VectorXYZ(XComponent=Slider(-3, range=-10..10), YComponent=0, ZComponent=0)  # -> Vector, Length
divide_28 = DivideCurve(Curve=cull_15, Count=10, Kinks=False)  # -> flatten(Points), Tangents, Parameters
end_17 = EndPoints(Curve=cull_15)  # -> Start, End
move_19 = Move(Geometry=extr_9, Motion=vec_73.Vector)  # -> Geometry, Transform
trim_23 = TrimWithBrep(Curve=cull_15, Brep=move_19.Geometry)  # -> Inside, Outside
crv_15 = Curve(trim_23.Inside)
item_176 = ListItem(List=divide_28.Points, Index=Slider(516, range=0..1000), Wrap=True)
item_177 = ListItem(List=divide_28.Points, Index=Slider(279, range=0..1000), Wrap=True)
item_178 = ListItem(List=end_17.End, Index=Slider(474, range=0..1000), Wrap=True)
item_179 = ListItem(List=end_17.Start, Index=Slider(65, range=0..1000), Wrap=item_178)
dist_17 = Distance(PointA=item_176, PointB=item_177)
dist_18 = Distance(PointA=item_179, PointB=item_178)
panel_27 = Panel(dist_17)
panel_28 = Panel(dist_18)

item_180 = ListItem(List=crv, Index=Slider(5, range=0..100), Wrap=True)
item_181 = ListItem(List=crv, Index=Slider(4, range=0..100), Wrap=True)
item_182 = ListItem(List=crv, Index=Slider(0, range=0..100), Wrap=True)
item_183 = ListItem(List=crv, Index=Slider(2, range=0..100), Wrap=True)
item_184 = ListItem(List=crv, Index=Slider(11, range=0..100), Wrap=True)
item_185 = ListItem(List=crv, Index=Slider(8, range=0..100), Wrap=True)
item_186 = ListItem(List=crv, Index=Slider(31, range=0..100), Wrap=True)
item_187 = ListItem(List=crv, Index=Slider(14, range=0..100), Wrap=True)
item_188 = ListItem(List=crv, Index=Slider(21, range=0..100), Wrap=True)
item_189 = ListItem(List=crv, Index=Slider(24, range=0..100), Wrap=True)
item_190 = ListItem(List=crv, Index=Slider(12, range=0..100), Wrap=True)
item_191 = ListItem(List=crv, Index=Slider(37, range=0..100), Wrap=True)
item_192 = ListItem(List=crv, Index=Slider(100, range=0..100), Wrap=True)
item_193 = ListItem(List=crv, Index=Slider(16, range=0..100), Wrap=True)
item_194 = ListItem(List=crv, Index=Slider(79, range=0..100), Wrap=True)
item_195 = ListItem(List=crv, Index=Slider(17, range=0..100), Wrap=True)
item_196 = ListItem(List=crv, Index=Slider(33, range=0..100), Wrap=True)
item_197 = ListItem(List=crv, Index=Slider(9, range=0..100), Wrap=True)
Y_16 = UnitY(Factor=1)
Y_17 = UnitY(Factor=1)
X_10 = UnitX(Factor=1)
Y_18 = UnitY(Factor=1)
Y_19 = UnitY(Factor=1)
Y_20 = UnitY(Factor=1)
Y_21 = UnitY(Factor=1)
vec_74 = VectorXYZ(XComponent=0, YComponent=Slider(3, range=-10..10), ZComponent=0)  # -> Vector, Length
vec_75 = VectorXYZ(XComponent=0, YComponent=Slider(3, range=-10..10), ZComponent=0)  # -> Vector, Length
vec_76 = VectorXYZ(XComponent=0, YComponent=Slider(3, range=-10..10), ZComponent=0)  # -> Vector, Length
vec_77 = VectorXYZ(XComponent=0, YComponent=Slider(3, range=-10..10), ZComponent=0)  # -> Vector, Length
vec_78 = VectorXYZ(XComponent=0, YComponent=Slider(-3, range=-10..10), ZComponent=0)  # -> Vector, Length

brep_14 = Brep(item_195)
debrep_20 = DeconstructBrep(Brep=brep_14)  # -> Faces, Edges, Vertices
number_slider_20 = Slider(17, range=0..100)
number_slider_21 = Slider(21, range=0..100)
divide_29 = DivideDomain²(Domain=debrep_20.Faces, UCount=number_slider_21, VCount=number_slider_20)
subsrf_10 = Isotrim(Surface=debrep_20.Faces, Domain=divide_29)
area_23 = Area(Geometry=subsrf_10)  # -> Area, Centroid
Y_22 = UnitY(Factor=1)
line_10 = LineSDL(Start=area_23.Centroid, Direction=Y_22, Length=Slider(8, range=0..10))
lng_10 = ListLength(List=line_10)
series_10 = Series(Start=0, Step=1, Count=lng_10)
vec_79 = VectorXYZ(XComponent=number_slider_21, YComponent=number_slider_20, ZComponent=0)  # -> Vector, Length
evalsrf_10 = EvaluateSurface(Surface=debrep_20.Faces, Point=vec_79.Vector)  # -> Point, Normal, UDirection, VDirection, Frame
mod_10 = Modulus(A=series_10, B="2")
equals_10 = Equality(FirstNumber=mod_10, SecondNumber="0")  # -> Equality, Inequality
cull_16 = CullPattern(List=line_10, CullPattern=equals_10.Inequality)
extr_10 = Extrude(Base=debrep_20.Faces, Direction=evalsrf_10.Normal)
vec_80 = VectorXYZ(XComponent=0, YComponent=Slider(3, range=-10..10), ZComponent=0)  # -> Vector, Length
move_20 = Move(Geometry=extr_10, Motion=vec_80.Vector)  # -> Geometry, Transform
trim_24 = TrimWithBrep(Curve=cull_16, Brep=move_20.Geometry)  # -> Inside, Outside
divide_30 = DivideCurve(Curve=cull_16, Count=10, Kinks=False)  # -> flatten(Points), Tangents, Parameters
end_18 = EndPoints(Curve=cull_16)  # -> Start, End
vec_81 = VectorXYZ(XComponent=0, YComponent=Slider(-2, range=-10..10), ZComponent=0)  # -> Vector, Length
move_21 = Move(Geometry=extr_10, Motion=vec_81.Vector)  # -> Geometry, Transform
trim_25 = TrimWithBrep(Curve=trim_24.Inside, Brep=move_21.Geometry)  # -> Inside, Outside
item_198 = ListItem(List=divide_30.Points, Index=Slider(10, range=0..100), Wrap=True)
item_199 = ListItem(List=divide_30.Points, Index=Slider(223, range=0..1000), Wrap=True)
item_200 = ListItem(List=end_18.End, Index=Slider(6, range=0..100), Wrap=True)
item_201 = ListItem(List=end_18.Start, Index=Slider(45, range=0..1000), Wrap=item_200)
crv_16 = Curve(trim_25.Inside)
dist_19 = Distance(PointA=item_198, PointB=item_199)
dist_20 = Distance(PointA=item_201, PointB=item_200)
panel_29 = Panel(dist_19)
panel_30 = Panel(dist_20)

brep_15 = Brep(item_194)
debrep_21 = DeconstructBrep(Brep=brep_15)  # -> Faces, Edges, Vertices
number_slider_22 = Slider(11, range=0..100)
number_slider_23 = Slider(12, range=0..100)
divide_31 = DivideDomain²(Domain=debrep_21.Faces, UCount=number_slider_23, VCount=number_slider_22)
subsrf_11 = Isotrim(Surface=debrep_21.Faces, Domain=divide_31)
area_24 = Area(Geometry=subsrf_11)  # -> Area, Centroid
line_11 = LineSDL(Start=area_24.Centroid, Direction=X_2, Length=Slider(8, range=0..10))
lng_11 = ListLength(List=line_11)
series_11 = Series(Start=0, Step=1, Count=lng_11)
vec_82 = VectorXYZ(XComponent=number_slider_23, YComponent=number_slider_22, ZComponent=0)  # -> Vector, Length
evalsrf_11 = EvaluateSurface(Surface=debrep_21.Faces, Point=vec_82.Vector)  # -> Point, Normal, UDirection, VDirection, Frame
mod_11 = Modulus(A=series_11, B="2")
equals_11 = Equality(FirstNumber=mod_11, SecondNumber="0")  # -> Equality, Inequality
cull_17 = CullPattern(List=line_11, CullPattern=equals_11.Inequality)
extr_11 = Extrude(Base=debrep_21.Faces, Direction=evalsrf_11.Normal)
vec_83 = VectorXYZ(XComponent=Slider(3, range=-10..10), YComponent=0, ZComponent=0)  # -> Vector, Length
move_22 = Move(Geometry=extr_11, Motion=vec_83.Vector)  # -> Geometry, Transform
vec_84 = VectorXYZ(XComponent=Slider(-3, range=-10..10), YComponent=0, ZComponent=0)  # -> Vector, Length
trim_26 = TrimWithBrep(Curve=cull_17, Brep=move_22.Geometry)  # -> Inside, Outside
divide_32 = DivideCurve(Curve=cull_17, Count=10, Kinks=False)  # -> flatten(Points), Tangents, Parameters
end_19 = EndPoints(Curve=cull_17)  # -> Start, End
move_23 = Move(Geometry=extr_11, Motion=vec_84.Vector)  # -> Geometry, Transform
trim_27 = TrimWithBrep(Curve=trim_26.Inside, Brep=move_23.Geometry)  # -> Inside, Outside
crv_17 = Curve(trim_27.Inside)
item_202 = ListItem(List=divide_32.Points, Index=Slider(10, range=0..100), Wrap=True)
item_203 = ListItem(List=divide_32.Points, Index=Slider(223, range=0..1000), Wrap=True)
item_204 = ListItem(List=end_19.End, Index=Slider(6, range=0..100), Wrap=True)
item_205 = ListItem(List=end_19.Start, Index=Slider(45, range=0..1000), Wrap=item_204)
dist_21 = Distance(PointA=item_202, PointB=item_203)
dist_22 = Distance(PointA=item_205, PointB=item_204)
panel_31 = Panel(dist_22)
panel_32 = Panel(dist_21)

brep_16 = Brep(item_190)
debrep_22 = DeconstructBrep(Brep=brep_16)  # -> Faces, Edges, Vertices
number_slider_24 = Slider(41, range=0..100)
number_slider_25 = Slider(9, range=0..100)
divide_33 = DivideDomain²(Domain=debrep_22.Faces, UCount=number_slider_25, VCount=number_slider_24)
subsrf_12 = Isotrim(Surface=debrep_22.Faces, Domain=divide_33)
area_25 = Area(Geometry=subsrf_12)  # -> Area, Centroid
vec_85 = VectorXYZ(XComponent=number_slider_25, YComponent=number_slider_24, ZComponent=0)  # -> Vector, Length
evalsrf_12 = EvaluateSurface(Surface=debrep_22.Faces, Point=vec_85.Vector)  # -> Point, Normal, UDirection, VDirection, Frame
line_12 = LineSDL(Start=area_25.Centroid, Direction=evalsrf_12.UDirection, Length=Slider(8, range=0..10))
lng_12 = ListLength(List=line_12)
series_12 = Series(Start=0, Step=1, Count=lng_12)
mod_12 = Modulus(A=series_12, B="2")
equals_12 = Equality(FirstNumber=mod_12, SecondNumber="0")  # -> Equality, Inequality
cull_18 = CullPattern(List=line_12, CullPattern=equals_12.Inequality)
extr_12 = Extrude(Base=debrep_22.Faces, Direction=evalsrf_12.Normal)
vec_86 = VectorXYZ(XComponent=Slider(-2, range=-10..10), YComponent=0, ZComponent=0)  # -> Vector, Length
move_24 = Move(Geometry=extr_12, Motion=vec_86.Vector)  # -> Geometry, Transform
vec_87 = VectorXYZ(XComponent=Slider(2, range=-10..10), YComponent=0, ZComponent=0)  # -> Vector, Length
trim_28 = TrimWithBrep(Curve=cull_18, Brep=move_24.Geometry)  # -> Inside, Outside
divide_34 = DivideCurve(Curve=cull_18, Count=10, Kinks=False)  # -> flatten(Points), Tangents, Parameters
end_20 = EndPoints(Curve=cull_18)  # -> Start, End
move_25 = Move(Geometry=extr_12, Motion=vec_87.Vector)  # -> Geometry, Transform
trim_29 = TrimWithBrep(Curve=trim_28.Inside, Brep=move_25.Geometry)  # -> Inside, Outside
crv_18 = Curve(trim_29.Inside)
item_206 = ListItem(List=divide_34.Points, Index=Slider(10, range=0..100), Wrap=True)
item_207 = ListItem(List=divide_34.Points, Index=Slider(223, range=0..1000), Wrap=True)
item_208 = ListItem(List=end_20.End, Index=Slider(6, range=0..100), Wrap=True)
item_209 = ListItem(List=end_20.Start, Index=Slider(45, range=0..1000), Wrap=item_208)
dist_23 = Distance(PointA=item_206, PointB=item_207)
dist_24 = Distance(PointA=item_209, PointB=item_208)
panel_33 = Panel(dist_24)
panel_34 = Panel(dist_23)

brep_17 = Brep(item_196)
debrep_23 = DeconstructBrep(Brep=brep_17)  # -> Faces, Edges, Vertices
number_slider_26 = Slider(47, range=0..100)
number_slider_27 = Slider(12, range=0..100)
divide_35 = DivideDomain²(Domain=debrep_23.Faces, UCount=number_slider_27, VCount=number_slider_26)
subsrf_13 = Isotrim(Surface=debrep_23.Faces, Domain=divide_35)
area_26 = Area(Geometry=subsrf_13)  # -> Area, Centroid
X_11 = UnitX(Factor=1)
line_13 = LineSDL(Start=area_26.Centroid, Direction=X_11, Length=Slider(8, range=0..10))
lng_13 = ListLength(List=line_13)
series_13 = Series(Start=0, Step=1, Count=lng_13)
vec_88 = VectorXYZ(XComponent=number_slider_27, YComponent=number_slider_26, ZComponent=0)  # -> Vector, Length
evalsrf_13 = EvaluateSurface(Surface=debrep_23.Faces, Point=vec_88.Vector)  # -> Point, Normal, UDirection, VDirection, Frame
mod_13 = Modulus(A=series_13, B="2")
equals_13 = Equality(FirstNumber=mod_13, SecondNumber="0")  # -> Equality, Inequality
cull_19 = CullPattern(List=line_13, CullPattern=equals_13.Inequality)
extr_13 = Extrude(Base=debrep_23.Faces, Direction=evalsrf_13.Normal)
vec_89 = VectorXYZ(XComponent=Slider(3, range=-10..10), YComponent=0, ZComponent=0)  # -> Vector, Length
divide_36 = DivideCurve(Curve=cull_19, Count=10, Kinks=False)  # -> flatten(Points), Tangents, Parameters
end_21 = EndPoints(Curve=cull_19)  # -> Start, End
move_26 = Move(Geometry=extr_13, Motion=vec_89.Vector)  # -> Geometry, Transform
trim_30 = TrimWithBrep(Curve=cull_19, Brep=move_26.Geometry)  # -> Inside, Outside
vec_90 = VectorXYZ(XComponent=Slider(-2, range=-10..10), YComponent=0, ZComponent=0)  # -> Vector, Length
move_27 = Move(Geometry=extr_13, Motion=vec_90.Vector)  # -> Geometry, Transform
trim_31 = TrimWithBrep(Curve=trim_30.Inside, Brep=move_27.Geometry)  # -> Inside, Outside
crv_19 = Curve(trim_31.Inside)
item_210 = ListItem(List=divide_36.Points, Index=Slider(156, range=0..1000), Wrap=True)
item_211 = ListItem(List=divide_36.Points, Index=Slider(305, range=0..1000), Wrap=True)
item_212 = ListItem(List=end_21.End, Index=Slider(86, range=0..1000), Wrap=True)
item_213 = ListItem(List=end_21.Start, Index=Slider(652, range=0..1000), Wrap=item_212)
dist_25 = Distance(PointA=item_210, PointB=item_211)
dist_26 = Distance(PointA=item_213, PointB=item_212)
panel_35 = Panel(dist_26)
panel_36 = Panel(dist_25)

brep_18 = Brep(item_191)
debrep_24 = DeconstructBrep(Brep=brep_18)  # -> Faces, Edges, Vertices
number_slider_28 = Slider(21, range=0..100)
number_slider_29 = Slider(7, range=0..100)
divide_37 = DivideDomain²(Domain=debrep_24.Faces, UCount=number_slider_28, VCount=number_slider_29)
subsrf_14 = Isotrim(Surface=debrep_24.Faces, Domain=divide_37)
area_27 = Area(Geometry=subsrf_14)  # -> Area, Centroid
X_12 = UnitX(Factor=1)
line_14 = LineSDL(Start=area_27.Centroid, Direction=X_12, Length=Slider(8, range=0..10))
lng_14 = ListLength(List=line_14)
series_14 = Series(Start=0, Step=1, Count=lng_14)
vec_91 = VectorXYZ(XComponent=number_slider_28, YComponent=number_slider_29, ZComponent=0)  # -> Vector, Length
evalsrf_14 = EvaluateSurface(Surface=debrep_24.Faces, Point=vec_91.Vector)  # -> Point, Normal, UDirection, VDirection, Frame
mod_14 = Modulus(A=series_14, B="2")
equals_14 = Equality(FirstNumber=mod_14, SecondNumber="0")  # -> Equality, Inequality
cull_20 = CullPattern(List=line_14, CullPattern=equals_14.Inequality)
divide_38 = DivideCurve(Curve=cull_20, Count=10, Kinks=False)  # -> flatten(Points), Tangents, Parameters
end_22 = EndPoints(Curve=cull_20)  # -> Start, End
extr_14 = Extrude(Base=debrep_24.Faces, Direction=evalsrf_14.Normal)
vec_92 = VectorXYZ(XComponent=Slider(-3, range=-10..10), YComponent=0, ZComponent=0)  # -> Vector, Length
move_28 = Move(Geometry=extr_14, Motion=vec_92.Vector)  # -> Geometry, Transform
trim_32 = TrimWithBrep(Curve=cull_20, Brep=move_28.Geometry)  # -> Inside, Outside
vec_93 = VectorXYZ(XComponent=Slider(2, range=-10..10), YComponent=0, ZComponent=0)  # -> Vector, Length
move_29 = Move(Geometry=extr_14, Motion=vec_93.Vector)  # -> Geometry, Transform
trim_33 = TrimWithBrep(Curve=trim_32.Inside, Brep=move_29.Geometry)  # -> Inside, Outside
item_214 = ListItem(List=divide_38.Points, Index=Slider(516, range=0..1000), Wrap=True)
item_215 = ListItem(List=divide_38.Points, Index=Slider(279, range=0..1000), Wrap=True)
item_216 = ListItem(List=end_22.End, Index=Slider(36, range=0..1000), Wrap=True)
item_217 = ListItem(List=end_22.Start, Index=Slider(65, range=0..1000), Wrap=item_216)
crv_20 = Curve(trim_33.Inside)
dist_27 = Distance(PointA=item_214, PointB=item_215)
dist_28 = Distance(PointA=item_217, PointB=item_216)
panel_37 = Panel(dist_27)
panel_38 = Panel(dist_28)

brep_19 = Brep(item_193)
debrep_25 = DeconstructBrep(Brep=brep_19)  # -> Faces, Edges, Vertices
number_slider_30 = Slider(7, range=0..100)
number_slider_31 = Slider(13, range=0..100)
divide_39 = DivideDomain²(Domain=debrep_25.Faces, UCount=number_slider_31, VCount=number_slider_30)
subsrf_15 = Isotrim(Surface=debrep_25.Faces, Domain=divide_39)
area_28 = Area(Geometry=subsrf_15)  # -> Area, Centroid
Y_23 = UnitY(Factor=1)
line_15 = LineSDL(Start=area_28.Centroid, Direction=Y_23, Length=Slider(8, range=0..10))
lng_15 = ListLength(List=line_15)
series_15 = Series(Start=0, Step=1, Count=lng_15)
vec_94 = VectorXYZ(XComponent=number_slider_31, YComponent=number_slider_30, ZComponent=0)  # -> Vector, Length
evalsrf_15 = EvaluateSurface(Surface=debrep_25.Faces, Point=vec_94.Vector)  # -> Point, Normal, UDirection, VDirection, Frame
mod_15 = Modulus(A=series_15, B="2")
equals_15 = Equality(FirstNumber=mod_15, SecondNumber="0")  # -> Equality, Inequality
cull_21 = CullPattern(List=line_15, CullPattern=equals_15.Inequality)
extr_15 = Extrude(Base=debrep_25.Faces, Direction=evalsrf_15.Normal)
vec_95 = VectorXYZ(XComponent=0, YComponent=Slider(-2, range=-10..10), ZComponent=0)  # -> Vector, Length
move_30 = Move(Geometry=extr_15, Motion=vec_95.Vector)  # -> Geometry, Transform
trim_34 = TrimWithBrep(Curve=cull_21, Brep=move_30.Geometry)  # -> Inside, Outside
divide_40 = DivideCurve(Curve=cull_21, Count=10, Kinks=False)  # -> flatten(Points), Tangents, Parameters
end_23 = EndPoints(Curve=cull_21)  # -> Start, End
vec_96 = VectorXYZ(XComponent=0, YComponent=Slider(3, range=-10..10), ZComponent=0)  # -> Vector, Length
move_31 = Move(Geometry=extr_15, Motion=vec_96.Vector)  # -> Geometry, Transform
trim_35 = TrimWithBrep(Curve=trim_34.Inside, Brep=move_31.Geometry)  # -> Inside, Outside
crv_21 = Curve(trim_35.Inside)
item_218 = ListItem(List=divide_40.Points, Index=Slider(760, range=0..1000), Wrap=True)
item_219 = ListItem(List=divide_40.Points, Index=Slider(623, range=0..1000), Wrap=True)
item_220 = ListItem(List=end_23.End, Index=Slider(80, range=0..100), Wrap=True)
item_221 = ListItem(List=end_23.Start, Index=Slider(103, range=0..1000), Wrap=item_220)
dist_29 = Distance(PointA=item_218, PointB=item_219)
dist_30 = Distance(PointA=item_221, PointB=item_220)
panel_39 = Panel(dist_30)
panel_40 = Panel(dist_29)

brep_20 = Brep(item_192)
debrep_26 = DeconstructBrep(Brep=brep_20)  # -> Faces, Edges, Vertices
number_slider_32 = Slider(11, range=0..100)
number_slider_33 = Slider(8, range=0..100)
divide_41 = DivideDomain²(Domain=debrep_26.Faces, UCount=number_slider_33, VCount=number_slider_32)
subsrf_16 = Isotrim(Surface=debrep_26.Faces, Domain=divide_41)
area_29 = Area(Geometry=subsrf_16)  # -> Area, Centroid
line_16 = LineSDL(Start=area_29.Centroid, Direction=X, Length=Slider(8, range=0..10))
lng_16 = ListLength(List=line_16)
series_16 = Series(Start=0, Step=1, Count=lng_16)
vec_97 = VectorXYZ(XComponent=number_slider_33, YComponent=number_slider_32, ZComponent=0)  # -> Vector, Length
evalsrf_16 = EvaluateSurface(Surface=debrep_26.Faces, Point=vec_97.Vector)  # -> Point, Normal, UDirection, VDirection, Frame
mod_16 = Modulus(A=series_16, B="2")
equals_16 = Equality(FirstNumber=mod_16, SecondNumber="0")  # -> Equality, Inequality
cull_22 = CullPattern(List=line_16, CullPattern=equals_16.Inequality)
extr_16 = Extrude(Base=debrep_26.Faces, Direction=evalsrf_16.Normal)
vec_98 = VectorXYZ(XComponent=0, YComponent=Slider(2, range=-10..10), ZComponent=0)  # -> Vector, Length
divide_42 = DivideCurve(Curve=cull_22, Count=10, Kinks=False)  # -> flatten(Points), Tangents, Parameters
end_24 = EndPoints(Curve=cull_22)  # -> Start, End
move_32 = Move(Geometry=extr_16, Motion=vec_98.Vector)  # -> Geometry, Transform
trim_36 = TrimWithBrep(Curve=cull_22, Brep=move_32.Geometry)  # -> Inside, Outside
vec_99 = VectorXYZ(XComponent=0, YComponent=Slider(-2, range=-10..10), ZComponent=0)  # -> Vector, Length
move_33 = Move(Geometry=extr_16, Motion=vec_99.Vector)  # -> Geometry, Transform
trim_37 = TrimWithBrep(Curve=trim_36.Inside, Brep=move_33.Geometry)  # -> Inside, Outside
crv_22 = Curve(trim_37.Inside)
item_222 = ListItem(List=divide_42.Points, Index=Slider(156, range=0..1000), Wrap=True)
item_223 = ListItem(List=divide_42.Points, Index=Slider(305, range=0..1000), Wrap=True)
item_224 = ListItem(List=end_24.End, Index=Slider(86, range=0..1000), Wrap=True)
item_225 = ListItem(List=end_24.Start, Index=Slider(652, range=0..1000), Wrap=item_224)
dist_31 = Distance(PointA=item_222, PointB=item_223)
dist_32 = Distance(PointA=item_225, PointB=item_224)
panel_41 = Panel(dist_32)
panel_42 = Panel(dist_31)

brep_21 = Brep(item_189)
debrep_27 = DeconstructBrep(Brep=brep_21)  # -> Faces, Edges, Vertices
number_slider_34 = Slider(21, range=0..100)
number_slider_35 = Slider(19, range=0..100)
divide_43 = DivideDomain²(Domain=debrep_27.Faces, UCount=number_slider_35, VCount=number_slider_34)
subsrf_17 = Isotrim(Surface=debrep_27.Faces, Domain=divide_43)
area_30 = Area(Geometry=subsrf_17)  # -> Area, Centroid
X_13 = UnitX(Factor=1)
line_17 = LineSDL(Start=area_30.Centroid, Direction=X_13, Length=Slider(8, range=0..10))
lng_17 = ListLength(List=line_17)
series_17 = Series(Start=0, Step=1, Count=lng_17)
vec_100 = VectorXYZ(XComponent=number_slider_35, YComponent=number_slider_34, ZComponent=0)  # -> Vector, Length
evalsrf_17 = EvaluateSurface(Surface=debrep_27.Faces, Point=vec_100.Vector)  # -> Point, Normal, UDirection, VDirection, Frame
mod_17 = Modulus(A=series_17, B="2")
equals_17 = Equality(FirstNumber=mod_17, SecondNumber="0")  # -> Equality, Inequality
cull_23 = CullPattern(List=line_17, CullPattern=equals_17.Inequality)
extr_17 = Extrude(Base=debrep_27.Faces, Direction=evalsrf_17.Normal)
vec_101 = VectorXYZ(XComponent=0, YComponent=Slider(-3, range=-10..10), ZComponent=0)  # -> Vector, Length
move_34 = Move(Geometry=extr_17, Motion=vec_101.Vector)  # -> Geometry, Transform
trim_38 = TrimWithBrep(Curve=cull_23, Brep=move_34.Geometry)  # -> Inside, Outside
divide_44 = DivideCurve(Curve=cull_23, Count=10, Kinks=False)  # -> flatten(Points), Tangents, Parameters
end_25 = EndPoints(Curve=cull_23)  # -> Start, End
vec_102 = VectorXYZ(XComponent=0, YComponent=Slider(1, range=-10..10), ZComponent=0)  # -> Vector, Length
move_35 = Move(Geometry=extr_17, Motion=vec_102.Vector)  # -> Geometry, Transform
trim_39 = TrimWithBrep(Curve=trim_38.Inside, Brep=move_35.Geometry)  # -> Inside, Outside
crv_23 = Curve(trim_39.Inside)
item_226 = ListItem(List=divide_44.Points, Index=Slider(760, range=0..1000), Wrap=True)
item_227 = ListItem(List=divide_44.Points, Index=Slider(623, range=0..1000), Wrap=True)
item_228 = ListItem(List=end_25.End, Index=Slider(80, range=0..100), Wrap=True)
item_229 = ListItem(List=end_25.Start, Index=Slider(103, range=0..1000), Wrap=item_228)
dist_33 = Distance(PointA=item_226, PointB=item_227)
dist_34 = Distance(PointA=item_229, PointB=item_228)
panel_43 = Panel(dist_34)
panel_44 = Panel(dist_33)

brep_22 = Brep(item_188)
debrep_28 = DeconstructBrep(Brep=brep_22)  # -> Faces, Edges, Vertices
number_slider_36 = Slider(17, range=0..100)
number_slider_37 = Slider(15, range=0..100)
divide_45 = DivideDomain²(Domain=debrep_28.Faces, UCount=number_slider_37, VCount=number_slider_36)
subsrf_18 = Isotrim(Surface=debrep_28.Faces, Domain=divide_45)
area_31 = Area(Geometry=subsrf_18)  # -> Area, Centroid
X_14 = UnitX(Factor=1)
line_18 = LineSDL(Start=area_31.Centroid, Direction=X_14, Length=Slider(8, range=0..10))
lng_18 = ListLength(List=line_18)
series_18 = Series(Start=0, Step=1, Count=lng_18)
vec_103 = VectorXYZ(XComponent=number_slider_37, YComponent=number_slider_36, ZComponent=0)  # -> Vector, Length
evalsrf_18 = EvaluateSurface(Surface=debrep_28.Faces, Point=vec_103.Vector)  # -> Point, Normal, UDirection, VDirection, Frame
mod_18 = Modulus(A=series_18, B="2")
equals_18 = Equality(FirstNumber=mod_18, SecondNumber="0")  # -> Equality, Inequality
cull_24 = CullPattern(List=line_18, CullPattern=equals_18.Inequality)
extr_18 = Extrude(Base=debrep_28.Faces, Direction=evalsrf_18.Normal)
vec_104 = VectorXYZ(XComponent=Slider(3, range=-10..10), YComponent=0, ZComponent=0)  # -> Vector, Length
divide_46 = DivideCurve(Curve=cull_24, Count=10, Kinks=False)  # -> flatten(Points), Tangents, Parameters
end_26 = EndPoints(Curve=cull_24)  # -> Start, End
move_36 = Move(Geometry=extr_18, Motion=vec_104.Vector)  # -> Geometry, Transform
trim_40 = TrimWithBrep(Curve=cull_24, Brep=move_36.Geometry)  # -> Inside, Outside
vec_105 = VectorXYZ(XComponent=Slider(-2, range=-10..10), YComponent=0, ZComponent=0)  # -> Vector, Length
move_37 = Move(Geometry=extr_18, Motion=vec_105.Vector)  # -> Geometry, Transform
trim_41 = TrimWithBrep(Curve=trim_40.Inside, Brep=move_37.Geometry)  # -> Inside, Outside
crv_24 = Curve(trim_41.Inside)
item_230 = ListItem(List=divide_46.Points, Index=Slider(156, range=0..1000), Wrap=True)
item_231 = ListItem(List=divide_46.Points, Index=Slider(305, range=0..1000), Wrap=True)
item_232 = ListItem(List=end_26.End, Index=Slider(86, range=0..1000), Wrap=True)
item_233 = ListItem(List=end_26.Start, Index=Slider(652, range=0..1000), Wrap=item_232)
dist_35 = Distance(PointA=item_230, PointB=item_231)
dist_36 = Distance(PointA=item_233, PointB=item_232)
panel_45 = Panel(dist_35)
panel_46 = Panel(dist_36)

brep_23 = Brep(item_182)
debrep_29 = DeconstructBrep(Brep=brep_23)  # -> Faces, Edges, Vertices
number_slider_38 = Slider(11, range=0..100)
number_slider_39 = Slider(8, range=0..100)
divide_47 = DivideDomain²(Domain=debrep_29.Faces, UCount=number_slider_39, VCount=number_slider_38)
subsrf_19 = Isotrim(Surface=debrep_29.Faces, Domain=divide_47)
area_32 = Area(Geometry=subsrf_19)  # -> Area, Centroid
line_19 = LineSDL(Start=area_32.Centroid, Direction=Y_2, Length=Slider(8, range=0..10))
lng_19 = ListLength(List=line_19)
series_19 = Series(Start=0, Step=1, Count=lng_19)
vec_106 = VectorXYZ(XComponent=number_slider_39, YComponent=number_slider_38, ZComponent=0)  # -> Vector, Length
evalsrf_19 = EvaluateSurface(Surface=debrep_29.Faces, Point=vec_106.Vector)  # -> Point, Normal, UDirection, VDirection, Frame
mod_19 = Modulus(A=series_19, B="2")
equals_19 = Equality(FirstNumber=mod_19, SecondNumber="0")  # -> Equality, Inequality
cull_25 = CullPattern(List=line_19, CullPattern=equals_19.Inequality)
extr_19 = Extrude(Base=debrep_29.Faces, Direction=evalsrf_19.Normal)
vec_107 = VectorXYZ(XComponent=0, YComponent=Slider(-2, range=-10..10), ZComponent=0)  # -> Vector, Length
divide_48 = DivideCurve(Curve=cull_25, Count=10, Kinks=False)  # -> flatten(Points), Tangents, Parameters
end_27 = EndPoints(Curve=cull_25)  # -> Start, End
move_38 = Move(Geometry=extr_19, Motion=vec_107.Vector)  # -> Geometry, Transform
trim_42 = TrimWithBrep(Curve=cull_25, Brep=move_38.Geometry)  # -> Inside, Outside
crv_25 = Curve(trim_42.Inside)
item_234 = ListItem(List=divide_48.Points, Index=Slider(516, range=0..1000), Wrap=True)
item_235 = ListItem(List=divide_48.Points, Index=Slider(279, range=0..1000), Wrap=True)
item_236 = ListItem(List=end_27.End, Index=Slider(474, range=0..1000), Wrap=True)
item_237 = ListItem(List=end_27.Start, Index=Slider(65, range=0..1000), Wrap=item_236)
dist_37 = Distance(PointA=item_234, PointB=item_235)
dist_38 = Distance(PointA=item_237, PointB=item_236)
panel_47 = Panel(dist_37)
panel_48 = Panel(dist_38)

brep_24 = Brep(item_197)
debrep_30 = DeconstructBrep(Brep=brep_24)  # -> Faces, Edges, Vertices
number_slider_40 = Slider(13, range=0..100)
number_slider_41 = Slider(30, range=0..100)
divide_49 = DivideDomain²(Domain=debrep_30.Faces, UCount=number_slider_41, VCount=number_slider_40)
subsrf_20 = Isotrim(Surface=debrep_30.Faces, Domain=divide_49)
area_33 = Area(Geometry=subsrf_20)  # -> Area, Centroid
line_20 = LineSDL(Start=area_33.Centroid, Direction=Y, Length=Slider(8, range=0..10))
lng_20 = ListLength(List=line_20)
series_20 = Series(Start=0, Step=1, Count=lng_20)
vec_108 = VectorXYZ(XComponent=number_slider_41, YComponent=number_slider_40, ZComponent=0)  # -> Vector, Length
evalsrf_20 = EvaluateSurface(Surface=debrep_30.Faces, Point=vec_108.Vector)  # -> Point, Normal, UDirection, VDirection, Frame
mod_20 = Modulus(A=series_20, B="2")
equals_20 = Equality(FirstNumber=mod_20, SecondNumber="0")  # -> Equality, Inequality
cull_26 = CullPattern(List=line_20, CullPattern=equals_20.Inequality)
extr_20 = Extrude(Base=debrep_30.Faces, Direction=evalsrf_20.Normal)
vec_109 = VectorXYZ(XComponent=0, YComponent=Slider(-3, range=-10..10), ZComponent=0)  # -> Vector, Length
move_39 = Move(Geometry=extr_20, Motion=vec_109.Vector)  # -> Geometry, Transform
trim_43 = TrimWithBrep(Curve=cull_26, Brep=move_39.Geometry)  # -> Inside, Outside
divide_50 = DivideCurve(Curve=cull_26, Count=10, Kinks=False)  # -> flatten(Points), Tangents, Parameters
end_28 = EndPoints(Curve=cull_26)  # -> Start, End
item_238 = ListItem(List=divide_50.Points, Index=Slider(10, range=0..100), Wrap=True)
item_239 = ListItem(List=divide_50.Points, Index=Slider(223, range=0..1000), Wrap=True)
item_240 = ListItem(List=end_28.End, Index=Slider(6, range=0..100), Wrap=True)
item_241 = ListItem(List=end_28.Start, Index=Slider(45, range=0..1000), Wrap=item_240)
dist_39 = Distance(PointA=item_238, PointB=item_239)
dist_40 = Distance(PointA=item_241, PointB=item_240)
panel_49 = Panel(dist_39)
panel_50 = Panel(dist_40)

move_40 = Move(Geometry=extr_20, Motion=vec_10.Vector)  # -> Geometry, Transform
trim_44 = TrimWithBrep(Curve=trim_43.Inside, Brep=move_40.Geometry)  # -> Inside, Outside

crv_26 = Curve(trim_44.Inside)

brep_25 = Brep(item_143)
debrep_31 = DeconstructBrep(Brep=brep_25)  # -> Faces, Edges, Vertices
number_slider_42 = Slider(39, range=0..100)
number_slider_43 = Slider(11, range=0..100)
divide_51 = DivideDomain²(Domain=debrep_31.Faces, UCount=number_slider_43, VCount=number_slider_42)
subsrf_21 = Isotrim(Surface=debrep_31.Faces, Domain=divide_51)
area_34 = Area(Geometry=subsrf_21)  # -> Area, Centroid
vec_110 = VectorXYZ(XComponent=number_slider_43, YComponent=number_slider_42, ZComponent=0)  # -> Vector, Length
evalsrf_21 = EvaluateSurface(Surface=debrep_31.Faces, Point=vec_110.Vector)  # -> Point, Normal, UDirection, VDirection, Frame
line_21 = LineSDL(Start=area_34.Centroid, Direction=evalsrf_21.UDirection, Length=Slider(8, range=0..10))
lng_21 = ListLength(List=line_21)
series_21 = Series(Start=0, Step=1, Count=lng_21)
mod_21 = Modulus(A=series_21, B="2")
equals_21 = Equality(FirstNumber=mod_21, SecondNumber="0")  # -> Equality, Inequality
cull_27 = CullPattern(List=line_21, CullPattern=equals_21.Inequality)
extr_21 = Extrude(Base=debrep_31.Faces, Direction=evalsrf_21.Normal)
vec_111 = VectorXYZ(XComponent=0, YComponent=Slider(-4, range=-10..10), ZComponent=0)  # -> Vector, Length
move_41 = Move(Geometry=extr_21, Motion=vec_111.Vector)  # -> Geometry, Transform
trim_45 = TrimWithBrep(Curve=cull_27, Brep=move_41.Geometry)  # -> Inside, Outside
divide_52 = DivideCurve(Curve=cull_27, Count=10, Kinks=False)  # -> flatten(Points), Tangents, Parameters
end_29 = EndPoints(Curve=cull_27)  # -> Start, End
item_242 = ListItem(List=divide_52.Points, Index=Slider(10, range=0..100), Wrap=True)
item_243 = ListItem(List=divide_52.Points, Index=Slider(223, range=0..1000), Wrap=True)
item_244 = ListItem(List=end_29.End, Index=Slider(6, range=0..100), Wrap=True)
item_245 = ListItem(List=end_29.Start, Index=Slider(45, range=0..1000), Wrap=item_244)
dist_41 = Distance(PointA=item_242, PointB=item_243)
dist_42 = Distance(PointA=item_245, PointB=item_244)
panel_51 = Panel(dist_42)
panel_52 = Panel(dist_41)

brep_26 = Brep(item_187)
debrep_32 = DeconstructBrep(Brep=brep_26)  # -> Faces, Edges, Vertices
number_slider_44 = Slider(39, range=0..100)
number_slider_45 = Slider(11, range=0..100)
divide_53 = DivideDomain²(Domain=debrep_32.Faces, UCount=number_slider_45, VCount=number_slider_44)
subsrf_22 = Isotrim(Surface=debrep_32.Faces, Domain=divide_53)
area_35 = Area(Geometry=subsrf_22)  # -> Area, Centroid
vec_112 = VectorXYZ(XComponent=number_slider_45, YComponent=number_slider_44, ZComponent=0)  # -> Vector, Length
evalsrf_22 = EvaluateSurface(Surface=debrep_32.Faces, Point=vec_112.Vector)  # -> Point, Normal, UDirection, VDirection, Frame
line_22 = LineSDL(Start=area_35.Centroid, Direction=evalsrf_22.UDirection, Length=Slider(8, range=0..10))
lng_22 = ListLength(List=line_22)
series_22 = Series(Start=0, Step=1, Count=lng_22)
mod_22 = Modulus(A=series_22, B="2")
equals_22 = Equality(FirstNumber=mod_22, SecondNumber="0")  # -> Equality, Inequality
cull_28 = CullPattern(List=line_22, CullPattern=equals_22.Inequality)
extr_22 = Extrude(Base=debrep_32.Faces, Direction=evalsrf_22.Normal)
vec_113 = VectorXYZ(XComponent=0, YComponent=Slider(-5, range=-10..10), ZComponent=0)  # -> Vector, Length
move_42 = Move(Geometry=extr_22, Motion=vec_113.Vector)  # -> Geometry, Transform
trim_46 = TrimWithBrep(Curve=cull_28, Brep=move_42.Geometry)  # -> Inside, Outside
divide_54 = DivideCurve(Curve=cull_28, Count=10, Kinks=False)  # -> flatten(Points), Tangents, Parameters
end_30 = EndPoints(Curve=cull_28)  # -> Start, End
item_246 = ListItem(List=divide_54.Points, Index=Slider(10, range=0..100), Wrap=True)
item_247 = ListItem(List=divide_54.Points, Index=Slider(223, range=0..1000), Wrap=True)
item_248 = ListItem(List=end_30.End, Index=Slider(6, range=0..100), Wrap=True)
item_249 = ListItem(List=end_30.Start, Index=Slider(45, range=0..1000), Wrap=item_248)
dist_43 = Distance(PointA=item_246, PointB=item_247)
dist_44 = Distance(PointA=item_249, PointB=item_248)
panel_53 = Panel(dist_43)
panel_54 = Panel(dist_44)

brep_27 = Brep(item_128)
debrep_33 = DeconstructBrep(Brep=brep_27)  # -> Faces, Edges, Vertices
number_slider_46 = Slider(39, range=0..100)
number_slider_47 = Slider(11, range=0..100)
divide_55 = DivideDomain²(Domain=debrep_33.Faces, UCount=number_slider_47, VCount=number_slider_46)
subsrf_23 = Isotrim(Surface=debrep_33.Faces, Domain=divide_55)
area_36 = Area(Geometry=subsrf_23)  # -> Area, Centroid
vec_114 = VectorXYZ(XComponent=number_slider_47, YComponent=number_slider_46, ZComponent=0)  # -> Vector, Length
evalsrf_23 = EvaluateSurface(Surface=debrep_33.Faces, Point=vec_114.Vector)  # -> Point, Normal, UDirection, VDirection, Frame
line_23 = LineSDL(Start=area_36.Centroid, Direction=evalsrf_23.UDirection, Length=Slider(8, range=0..10))
lng_23 = ListLength(List=line_23)
series_23 = Series(Start=0, Step=1, Count=lng_23)
mod_23 = Modulus(A=series_23, B="2")
equals_23 = Equality(FirstNumber=mod_23, SecondNumber="0")  # -> Equality, Inequality
cull_29 = CullPattern(List=line_23, CullPattern=equals_23.Inequality)
extr_23 = Extrude(Base=debrep_33.Faces, Direction=evalsrf_23.Normal)
vec_115 = VectorXYZ(XComponent=0, YComponent=Slider(-5, range=-10..10), ZComponent=0)  # -> Vector, Length
move_43 = Move(Geometry=extr_23, Motion=vec_115.Vector)  # -> Geometry, Transform
trim_47 = TrimWithBrep(Curve=cull_29, Brep=move_43.Geometry)  # -> Inside, Outside
divide_56 = DivideCurve(Curve=cull_29, Count=10, Kinks=False)  # -> flatten(Points), Tangents, Parameters
end_31 = EndPoints(Curve=cull_29)  # -> Start, End
item_250 = ListItem(List=divide_56.Points, Index=Slider(10, range=0..100), Wrap=True)
item_251 = ListItem(List=divide_56.Points, Index=Slider(223, range=0..1000), Wrap=True)
item_252 = ListItem(List=end_31.End, Index=Slider(6, range=0..100), Wrap=True)
item_253 = ListItem(List=end_31.Start, Index=Slider(45, range=0..1000), Wrap=item_252)
dist_45 = Distance(PointA=item_250, PointB=item_251)
dist_46 = Distance(PointA=item_253, PointB=item_252)
panel_55 = Panel(dist_46)
panel_56 = Panel(dist_45)

brep_28 = Brep(item_132)
debrep_34 = DeconstructBrep(Brep=brep_28)  # -> Faces, Edges, Vertices
number_slider_48 = Slider(76, range=0..100)
number_slider_49 = Slider(33, range=0..100)
divide_57 = DivideDomain²(Domain=debrep_34.Faces, UCount=number_slider_48, VCount=number_slider_49)
subsrf_24 = Isotrim(Surface=debrep_34.Faces, Domain=divide_57)
area_37 = Area(Geometry=subsrf_24)  # -> Area, Centroid
line_24 = LineSDL(Start=area_37.Centroid, Direction=Y_10, Length=Slider(8, range=0..10))
lng_24 = ListLength(List=line_24)
series_24 = Series(Start=0, Step=1, Count=lng_24)
vec_116 = VectorXYZ(XComponent=number_slider_48, YComponent=number_slider_49, ZComponent=0)  # -> Vector, Length
evalsrf_24 = EvaluateSurface(Surface=debrep_34.Faces, Point=vec_116.Vector)  # -> Point, Normal, UDirection, VDirection, Frame
mod_24 = Modulus(A=series_24, B="2")
equals_24 = Equality(FirstNumber=mod_24, SecondNumber="0")  # -> Equality, Inequality
cull_30 = CullPattern(List=line_24, CullPattern=equals_24.Inequality)
divide_58 = DivideCurve(Curve=cull_30, Count=10, Kinks=False)  # -> flatten(Points), Tangents, Parameters
end_32 = EndPoints(Curve=cull_30)  # -> Start, End
extr_24 = Extrude(Base=debrep_34.Faces, Direction=evalsrf_24.Normal)
vec_117 = VectorXYZ(XComponent=Slider(0, range=-10..10), YComponent=0, ZComponent=0)  # -> Vector, Length
move_44 = Move(Geometry=extr_24, Motion=vec_117.Vector)  # -> Geometry, Transform
trim_48 = TrimWithBrep(Curve=cull_30, Brep=move_44.Geometry)  # -> Inside, Outside
item_254 = ListItem(List=divide_58.Points, Index=Slider(516, range=0..1000), Wrap=True)
item_255 = ListItem(List=divide_58.Points, Index=Slider(279, range=0..1000), Wrap=True)
item_256 = ListItem(List=end_32.End, Index=Slider(36, range=0..1000), Wrap=True)
item_257 = ListItem(List=end_32.Start, Index=Slider(65, range=0..1000), Wrap=item_256)
dist_47 = Distance(PointA=item_254, PointB=item_255)
dist_48 = Distance(PointA=item_257, PointB=item_256)
panel_57 = Panel(dist_47)
panel_58 = Panel(dist_48)

brep_29 = Brep(item_134)
debrep_35 = DeconstructBrep(Brep=brep_29)  # -> Faces, Edges, Vertices
number_slider_50 = Slider(50, range=0..100)
number_slider_51 = Slider(60, range=0..100)
divide_59 = DivideDomain²(Domain=debrep_35.Faces, UCount=number_slider_51, VCount=number_slider_50)
subsrf_25 = Isotrim(Surface=debrep_35.Faces, Domain=divide_59)
area_38 = Area(Geometry=subsrf_25)  # -> Area, Centroid
line_25 = LineSDL(Start=area_38.Centroid, Direction=X_5, Length=Slider(8, range=0..10))
lng_25 = ListLength(List=line_25)
series_25 = Series(Start=0, Step=1, Count=lng_25)
vec_118 = VectorXYZ(XComponent=number_slider_51, YComponent=number_slider_50, ZComponent=0)  # -> Vector, Length
evalsrf_25 = EvaluateSurface(Surface=debrep_35.Faces, Point=vec_118.Vector)  # -> Point, Normal, UDirection, VDirection, Frame
mod_25 = Modulus(A=series_25, B="2")
equals_25 = Equality(FirstNumber=mod_25, SecondNumber="0")  # -> Equality, Inequality
cull_31 = CullPattern(List=line_25, CullPattern=equals_25.Inequality)
extr_25 = Extrude(Base=debrep_35.Faces, Direction=evalsrf_25.Normal)
vec_119 = VectorXYZ(XComponent=0, YComponent=Slider(-2, range=-10..10), ZComponent=0)  # -> Vector, Length
move_45 = Move(Geometry=extr_25, Motion=vec_119.Vector)  # -> Geometry, Transform
trim_49 = TrimWithBrep(Curve=cull_31, Brep=move_45.Geometry)  # -> Inside, Outside
divide_60 = DivideCurve(Curve=cull_31, Count=10, Kinks=False)  # -> flatten(Points), Tangents, Parameters
end_33 = EndPoints(Curve=cull_31)  # -> Start, End
item_258 = ListItem(List=divide_60.Points, Index=Slider(760, range=0..1000), Wrap=True)
item_259 = ListItem(List=divide_60.Points, Index=Slider(623, range=0..1000), Wrap=True)
item_260 = ListItem(List=end_33.End, Index=Slider(80, range=0..100), Wrap=True)
item_261 = ListItem(List=end_33.Start, Index=Slider(103, range=0..1000), Wrap=item_260)
dist_49 = Distance(PointA=item_258, PointB=item_259)
dist_50 = Distance(PointA=item_261, PointB=item_260)
panel_59 = Panel(dist_50)
panel_60 = Panel(dist_49)

brep_30 = Brep(item_133)
number_slider_52 = Slider(62, range=0..100)
number_slider_53 = Slider(66, range=0..100)
vec_120 = VectorXYZ(XComponent=number_slider_53, YComponent=number_slider_52, ZComponent=0)  # -> Vector, Length
vec_121 = VectorXYZ(XComponent=0, YComponent=Slider(3, range=-10..10), ZComponent=0)  # -> Vector, Length
vec_122 = VectorXYZ(XComponent=0, YComponent=Slider(-2, range=-10..10), ZComponent=0)  # -> Vector, Length

brep_31 = Brep(item_180)
debrep_36 = DeconstructBrep(Brep=brep_31)  # -> Faces, Edges, Vertices
number_slider_54 = Slider(13, range=0..100)
number_slider_55 = Slider(30, range=0..100)
divide_61 = DivideDomain²(Domain=debrep_36.Faces, UCount=number_slider_55, VCount=number_slider_54)
subsrf_26 = Isotrim(Surface=debrep_36.Faces, Domain=divide_61)
area_39 = Area(Geometry=subsrf_26)  # -> Area, Centroid
line_26 = LineSDL(Start=area_39.Centroid, Direction=Y_19, Length=Slider(8, range=0..10))
lng_26 = ListLength(List=line_26)
series_26 = Series(Start=0, Step=1, Count=lng_26)
vec_123 = VectorXYZ(XComponent=number_slider_55, YComponent=number_slider_54, ZComponent=0)  # -> Vector, Length
evalsrf_26 = EvaluateSurface(Surface=debrep_36.Faces, Point=vec_123.Vector)  # -> Point, Normal, UDirection, VDirection, Frame
mod_26 = Modulus(A=series_26, B="2")
equals_26 = Equality(FirstNumber=mod_26, SecondNumber="0")  # -> Equality, Inequality
cull_32 = CullPattern(List=line_26, CullPattern=equals_26.Inequality)
extr_26 = Extrude(Base=debrep_36.Faces, Direction=evalsrf_26.Normal)
vec_124 = VectorXYZ(XComponent=0, YComponent=Slider(-5, range=-10..10), ZComponent=0)  # -> Vector, Length
move_46 = Move(Geometry=extr_26, Motion=vec_124.Vector)  # -> Geometry, Transform
trim_50 = TrimWithBrep(Curve=cull_32, Brep=move_46.Geometry)  # -> Inside, Outside
divide_62 = DivideCurve(Curve=cull_32, Count=10, Kinks=False)  # -> flatten(Points), Tangents, Parameters
end_34 = EndPoints(Curve=cull_32)  # -> Start, End
item_262 = ListItem(List=divide_62.Points, Index=Slider(10, range=0..100), Wrap=True)
item_263 = ListItem(List=divide_62.Points, Index=Slider(223, range=0..1000), Wrap=True)
item_264 = ListItem(List=end_34.End, Index=Slider(6, range=0..100), Wrap=True)
item_265 = ListItem(List=end_34.Start, Index=Slider(45, range=0..1000), Wrap=item_264)
dist_51 = Distance(PointA=item_262, PointB=item_263)
dist_52 = Distance(PointA=item_265, PointB=item_264)
panel_61 = Panel(dist_52)
panel_62 = Panel(dist_51)

brep_32 = Brep(item_184)
debrep_37 = DeconstructBrep(Brep=brep_32)  # -> Faces, Edges, Vertices
number_slider_56 = Slider(76, range=0..100)
number_slider_57 = Slider(33, range=0..100)
divide_63 = DivideDomain²(Domain=debrep_37.Faces, UCount=number_slider_56, VCount=number_slider_57)
subsrf_27 = Isotrim(Surface=debrep_37.Faces, Domain=divide_63)
area_40 = Area(Geometry=subsrf_27)  # -> Area, Centroid
line_27 = LineSDL(Start=area_40.Centroid, Direction=Y_21, Length=Slider(8, range=0..10))
lng_27 = ListLength(List=line_27)
series_27 = Series(Start=0, Step=1, Count=lng_27)
vec_125 = VectorXYZ(XComponent=number_slider_56, YComponent=number_slider_57, ZComponent=0)  # -> Vector, Length
evalsrf_27 = EvaluateSurface(Surface=debrep_37.Faces, Point=vec_125.Vector)  # -> Point, Normal, UDirection, VDirection, Frame
mod_27 = Modulus(A=series_27, B="2")
equals_27 = Equality(FirstNumber=mod_27, SecondNumber="0")  # -> Equality, Inequality
cull_33 = CullPattern(List=line_27, CullPattern=equals_27.Inequality)
divide_64 = DivideCurve(Curve=cull_33, Count=10, Kinks=False)  # -> flatten(Points), Tangents, Parameters
end_35 = EndPoints(Curve=cull_33)  # -> Start, End
extr_27 = Extrude(Base=debrep_37.Faces, Direction=evalsrf_27.Normal)
vec_126 = VectorXYZ(XComponent=Slider(0, range=-10..10), YComponent=0, ZComponent=0)  # -> Vector, Length
move_47 = Move(Geometry=extr_27, Motion=vec_126.Vector)  # -> Geometry, Transform
trim_51 = TrimWithBrep(Curve=cull_33, Brep=move_47.Geometry)  # -> Inside, Outside
item_266 = ListItem(List=divide_64.Points, Index=Slider(516, range=0..1000), Wrap=True)
item_267 = ListItem(List=divide_64.Points, Index=Slider(279, range=0..1000), Wrap=True)
item_268 = ListItem(List=end_35.End, Index=Slider(36, range=0..1000), Wrap=True)
item_269 = ListItem(List=end_35.Start, Index=Slider(65, range=0..1000), Wrap=item_268)
dist_53 = Distance(PointA=item_266, PointB=item_267)
dist_54 = Distance(PointA=item_269, PointB=item_268)
panel_63 = Panel(dist_53)
panel_64 = Panel(dist_54)

brep_33 = Brep(item_186)
debrep_38 = DeconstructBrep(Brep=brep_33)  # -> Faces, Edges, Vertices
number_slider_58 = Slider(50, range=0..100)
number_slider_59 = Slider(60, range=0..100)
divide_65 = DivideDomain²(Domain=debrep_38.Faces, UCount=number_slider_59, VCount=number_slider_58)
subsrf_28 = Isotrim(Surface=debrep_38.Faces, Domain=divide_65)
area_41 = Area(Geometry=subsrf_28)  # -> Area, Centroid
line_28 = LineSDL(Start=area_41.Centroid, Direction=X_10, Length=Slider(8, range=0..10))
lng_28 = ListLength(List=line_28)
series_28 = Series(Start=0, Step=1, Count=lng_28)
vec_127 = VectorXYZ(XComponent=number_slider_59, YComponent=number_slider_58, ZComponent=0)  # -> Vector, Length
evalsrf_28 = EvaluateSurface(Surface=debrep_38.Faces, Point=vec_127.Vector)  # -> Point, Normal, UDirection, VDirection, Frame
mod_28 = Modulus(A=series_28, B="2")
equals_28 = Equality(FirstNumber=mod_28, SecondNumber="0")  # -> Equality, Inequality
cull_34 = CullPattern(List=line_28, CullPattern=equals_28.Inequality)
extr_28 = Extrude(Base=debrep_38.Faces, Direction=evalsrf_28.Normal)
vec_128 = VectorXYZ(XComponent=0, YComponent=Slider(-2, range=-10..10), ZComponent=0)  # -> Vector, Length
move_48 = Move(Geometry=extr_28, Motion=vec_128.Vector)  # -> Geometry, Transform
trim_52 = TrimWithBrep(Curve=cull_34, Brep=move_48.Geometry)  # -> Inside, Outside
divide_66 = DivideCurve(Curve=cull_34, Count=10, Kinks=False)  # -> flatten(Points), Tangents, Parameters
end_36 = EndPoints(Curve=cull_34)  # -> Start, End
item_270 = ListItem(List=divide_66.Points, Index=Slider(760, range=0..1000), Wrap=True)
item_271 = ListItem(List=divide_66.Points, Index=Slider(623, range=0..1000), Wrap=True)
item_272 = ListItem(List=end_36.End, Index=Slider(80, range=0..100), Wrap=True)
item_273 = ListItem(List=end_36.Start, Index=Slider(103, range=0..1000), Wrap=item_272)
dist_55 = Distance(PointA=item_270, PointB=item_271)
dist_56 = Distance(PointA=item_273, PointB=item_272)
panel_65 = Panel(dist_56)
panel_66 = Panel(dist_55)

brep_34 = Brep(item_185)
number_slider_60 = Slider(62, range=0..100)
number_slider_61 = Slider(66, range=0..100)
vec_129 = VectorXYZ(XComponent=number_slider_61, YComponent=number_slider_60, ZComponent=0)  # -> Vector, Length
vec_130 = VectorXYZ(XComponent=0, YComponent=Slider(3, range=-10..10), ZComponent=0)  # -> Vector, Length
vec_131 = VectorXYZ(XComponent=0, YComponent=Slider(-2, range=-10..10), ZComponent=0)  # -> Vector, Length

brep_35 = Brep(item_130)
debrep_39 = DeconstructBrep(Brep=brep_35)  # -> Faces, Edges, Vertices
number_slider_62 = Slider(15, range=0..100)
number_slider_63 = Slider(30, range=0..100)
divide_67 = DivideDomain²(Domain=debrep_39.Faces, UCount=number_slider_63, VCount=number_slider_62)
subsrf_29 = Isotrim(Surface=debrep_39.Faces, Domain=divide_67)
area_42 = Area(Geometry=subsrf_29)  # -> Area, Centroid
line_29 = LineSDL(Start=area_42.Centroid, Direction=Y_9, Length=Slider(8, range=0..10))
lng_29 = ListLength(List=line_29)
series_29 = Series(Start=0, Step=1, Count=lng_29)
vec_132 = VectorXYZ(XComponent=number_slider_63, YComponent=number_slider_62, ZComponent=0)  # -> Vector, Length
evalsrf_29 = EvaluateSurface(Surface=debrep_39.Faces, Point=vec_132.Vector)  # -> Point, Normal, UDirection, VDirection, Frame
mod_29 = Modulus(A=series_29, B="2")
equals_29 = Equality(FirstNumber=mod_29, SecondNumber="0")  # -> Equality, Inequality
cull_35 = CullPattern(List=line_29, CullPattern=equals_29.Inequality)
extr_29 = Extrude(Base=debrep_39.Faces, Direction=evalsrf_29.Normal)
vec_133 = VectorXYZ(XComponent=0, YComponent=Slider(-2, range=-10..10), ZComponent=0)  # -> Vector, Length
move_49 = Move(Geometry=extr_29, Motion=vec_133.Vector)  # -> Geometry, Transform
trim_53 = TrimWithBrep(Curve=cull_35, Brep=move_49.Geometry)  # -> Inside, Outside
divide_68 = DivideCurve(Curve=cull_35, Count=10, Kinks=False)  # -> flatten(Points), Tangents, Parameters
end_37 = EndPoints(Curve=cull_35)  # -> Start, End
item_274 = ListItem(List=divide_68.Points, Index=Slider(760, range=0..1000), Wrap=True)
item_275 = ListItem(List=divide_68.Points, Index=Slider(623, range=0..1000), Wrap=True)
item_276 = ListItem(List=end_37.End, Index=Slider(80, range=0..100), Wrap=True)
item_277 = ListItem(List=end_37.Start, Index=Slider(103, range=0..1000), Wrap=item_276)
dist_57 = Distance(PointA=item_274, PointB=item_275)
dist_58 = Distance(PointA=item_277, PointB=item_276)
panel_67 = Panel(dist_57)
panel_68 = Panel(dist_58)

brep_36 = Brep(item_129)
number_slider_64 = Slider(13, range=0..100)
number_slider_65 = Slider(30, range=0..100)
vec_134 = VectorXYZ(XComponent=number_slider_65, YComponent=number_slider_64, ZComponent=0)  # -> Vector, Length
vec_135 = VectorXYZ(XComponent=0, YComponent=Slider(3, range=-10..10), ZComponent=0)  # -> Vector, Length
vec_136 = VectorXYZ(XComponent=0, YComponent=Slider(-2, range=-10..10), ZComponent=0)  # -> Vector, Length

brep_37 = Brep(item_181)
debrep_40 = DeconstructBrep(Brep=brep_37)  # -> Faces, Edges, Vertices
number_slider_66 = Slider(12, range=0..100)
number_slider_67 = Slider(9, range=0..100)
divide_69 = DivideDomain²(Domain=debrep_40.Faces, UCount=number_slider_67, VCount=number_slider_66)
subsrf_30 = Isotrim(Surface=debrep_40.Faces, Domain=divide_69)
area_43 = Area(Geometry=subsrf_30)  # -> Area, Centroid
line_30 = LineSDL(Start=area_43.Centroid, Direction=Y_20, Length=Slider(8, range=0..10))
lng_30 = ListLength(List=line_30)
vec_137 = VectorXYZ(XComponent=number_slider_67, YComponent=number_slider_66, ZComponent=0)  # -> Vector, Length
evalsrf_30 = EvaluateSurface(Surface=debrep_40.Faces, Point=vec_137.Vector)  # -> Point, Normal, UDirection, VDirection, Frame
series_30 = Series(Start=0, Step=evalsrf_30.UDirection, Count=lng_30)
mod_30 = Modulus(A=series_30, B="2")
equals_30 = Equality(FirstNumber=mod_30, SecondNumber="0")  # -> Equality, Inequality
cull_36 = CullPattern(List=line_30, CullPattern=equals_30.Inequality)
extr_30 = Extrude(Base=debrep_40.Faces, Direction=evalsrf_30.Normal)
vec_138 = VectorXYZ(XComponent=0, YComponent=Slider(-2, range=-10..10), ZComponent=0)  # -> Vector, Length
move_50 = Move(Geometry=extr_30, Motion=vec_138.Vector)  # -> Geometry, Transform
trim_54 = TrimWithBrep(Curve=cull_36, Brep=move_50.Geometry)  # -> Inside, Outside
divide_70 = DivideCurve(Curve=cull_36, Count=10, Kinks=False)  # -> flatten(Points), Tangents, Parameters
end_38 = EndPoints(Curve=cull_36)  # -> Start, End
item_278 = ListItem(List=divide_70.Points, Index=Slider(760, range=0..1000), Wrap=True)
item_279 = ListItem(List=divide_70.Points, Index=Slider(623, range=0..1000), Wrap=True)
item_280 = ListItem(List=end_38.End, Index=Slider(80, range=0..100), Wrap=True)
item_281 = ListItem(List=end_38.Start, Index=Slider(103, range=0..1000), Wrap=item_280)
dist_59 = Distance(PointA=item_278, PointB=item_279)
dist_60 = Distance(PointA=item_281, PointB=item_280)
panel_69 = Panel(dist_60)
panel_70 = Panel(dist_59)

brep_38 = Brep(item_183)
number_slider_68 = Slider(39, range=0..100)
number_slider_69 = Slider(11, range=0..100)
vec_139 = VectorXYZ(XComponent=number_slider_69, YComponent=number_slider_68, ZComponent=0)  # -> Vector, Length
vec_140 = VectorXYZ(XComponent=0, YComponent=Slider(3, range=-10..10), ZComponent=0)  # -> Vector, Length
vec_141 = VectorXYZ(XComponent=0, YComponent=Slider(-2, range=-10..10), ZComponent=0)  # -> Vector, Length

debrep_41 = DeconstructBrep(Brep=brep_30)  # -> Faces, Edges, Vertices
debrep_42 = DeconstructBrep(Brep=brep_36)  # -> Faces, Edges, Vertices
move_51 = Move(Geometry=extr_21, Motion=vec_43.Vector)  # -> Geometry, Transform
move_52 = Move(Geometry=extr_25, Motion=vec_44.Vector)  # -> Geometry, Transform
move_53 = Move(Geometry=extr_23, Motion=vec_45.Vector)  # -> Geometry, Transform
move_54 = Move(Geometry=extr_29, Motion=vec_46.Vector)  # -> Geometry, Transform
trim_55 = TrimWithBrep(Curve=trim_45.Inside, Brep=move_51.Geometry)  # -> Inside, Outside
trim_56 = TrimWithBrep(Curve=trim_49.Inside, Brep=move_52.Geometry)  # -> Inside, Outside
trim_57 = TrimWithBrep(Curve=trim_47.Inside, Brep=move_53.Geometry)  # -> Inside, Outside
trim_58 = TrimWithBrep(Curve=trim_53.Inside, Brep=move_54.Geometry)  # -> Inside, Outside
move_55 = Move(Geometry=extr_24, Motion=vec_47.Vector)  # -> Geometry, Transform
trim_59 = TrimWithBrep(Curve=trim_48.Inside, Brep=move_55.Geometry)  # -> Inside, Outside

crv_27 = Curve(trim_55.Inside)

crv_28 = Curve(trim_56.Inside)

crv_29 = Curve(trim_58.Inside)

crv_30 = Curve(trim_57.Inside)

crv_31 = Curve(trim_59.Inside)

debrep_43 = DeconstructBrep(Brep=brep_34)  # -> Faces, Edges, Vertices
debrep_44 = DeconstructBrep(Brep=brep_38)  # -> Faces, Edges, Vertices
move_56 = Move(Geometry=extr_22, Motion=vec_74.Vector)  # -> Geometry, Transform
move_57 = Move(Geometry=extr_28, Motion=vec_75.Vector)  # -> Geometry, Transform
move_58 = Move(Geometry=extr_26, Motion=vec_76.Vector)  # -> Geometry, Transform
move_59 = Move(Geometry=extr_30, Motion=vec_77.Vector)  # -> Geometry, Transform
trim_60 = TrimWithBrep(Curve=trim_46.Inside, Brep=move_56.Geometry)  # -> Inside, Outside
trim_61 = TrimWithBrep(Curve=trim_52.Inside, Brep=move_57.Geometry)  # -> Inside, Outside
trim_62 = TrimWithBrep(Curve=trim_50.Inside, Brep=move_58.Geometry)  # -> Inside, Outside
trim_63 = TrimWithBrep(Curve=trim_54.Inside, Brep=move_59.Geometry)  # -> Inside, Outside
move_60 = Move(Geometry=extr_27, Motion=vec_78.Vector)  # -> Geometry, Transform
trim_64 = TrimWithBrep(Curve=trim_51.Inside, Brep=move_60.Geometry)  # -> Inside, Outside

crv_32 = Curve(trim_60.Inside)

crv_33 = Curve(trim_61.Inside)

crv_34 = Curve(trim_63.Inside)

crv_35 = Curve(trim_62.Inside)

crv_36 = Curve(trim_64.Inside)

divide_71 = DivideDomain²(Domain=debrep_41.Faces, UCount=number_slider_53, VCount=number_slider_52)
subsrf_31 = Isotrim(Surface=debrep_41.Faces, Domain=divide_71)
area_44 = Area(Geometry=subsrf_31)  # -> Area, Centroid
line_31 = LineSDL(Start=area_44.Centroid, Direction=Y_6, Length=Slider(8, range=0..10))
lng_31 = ListLength(List=line_31)
series_31 = Series(Start=0, Step=1, Count=lng_31)
evalsrf_31 = EvaluateSurface(Surface=debrep_41.Faces, Point=vec_120.Vector)  # -> Point, Normal, UDirection, VDirection, Frame
mod_31 = Modulus(A=series_31, B="2")
equals_31 = Equality(FirstNumber=mod_31, SecondNumber="0")  # -> Equality, Inequality
cull_37 = CullPattern(List=line_31, CullPattern=equals_31.Inequality)
extr_31 = Extrude(Base=debrep_41.Faces, Direction=evalsrf_31.Normal)
end_39 = EndPoints(Curve=cull_37)  # -> Start, End
move_61 = Move(Geometry=extr_31, Motion=vec_121.Vector)  # -> Geometry, Transform
trim_65 = TrimWithBrep(Curve=cull_37, Brep=move_61.Geometry)  # -> Inside, Outside
move_62 = Move(Geometry=extr_31, Motion=vec_122.Vector)  # -> Geometry, Transform
trim_66 = TrimWithBrep(Curve=trim_65.Inside, Brep=move_62.Geometry)  # -> Inside, Outside
crv_37 = Curve(trim_66.Inside)
item_282 = ListItem(List=end_39.End, Index=Slider(86, range=0..1000), Wrap=True)
item_283 = ListItem(List=end_39.Start, Index=Slider(652, range=0..1000), Wrap=item_282)
dist_61 = Distance(PointA=item_283, PointB=item_282)
panel_71 = Panel(dist_61)

divide_72 = DivideDomain²(Domain=debrep_43.Faces, UCount=number_slider_61, VCount=number_slider_60)
subsrf_32 = Isotrim(Surface=debrep_43.Faces, Domain=divide_72)
area_45 = Area(Geometry=subsrf_32)  # -> Area, Centroid
line_32 = LineSDL(Start=area_45.Centroid, Direction=Y_17, Length=Slider(8, range=0..10))
lng_32 = ListLength(List=line_32)
series_32 = Series(Start=0, Step=1, Count=lng_32)
evalsrf_32 = EvaluateSurface(Surface=debrep_43.Faces, Point=vec_129.Vector)  # -> Point, Normal, UDirection, VDirection, Frame
mod_32 = Modulus(A=series_32, B="2")
equals_32 = Equality(FirstNumber=mod_32, SecondNumber="0")  # -> Equality, Inequality
cull_38 = CullPattern(List=line_32, CullPattern=equals_32.Inequality)
extr_32 = Extrude(Base=debrep_43.Faces, Direction=evalsrf_32.Normal)
end_40 = EndPoints(Curve=cull_38)  # -> Start, End
move_63 = Move(Geometry=extr_32, Motion=vec_130.Vector)  # -> Geometry, Transform
trim_67 = TrimWithBrep(Curve=cull_38, Brep=move_63.Geometry)  # -> Inside, Outside
move_64 = Move(Geometry=extr_32, Motion=vec_131.Vector)  # -> Geometry, Transform
trim_68 = TrimWithBrep(Curve=trim_67.Inside, Brep=move_64.Geometry)  # -> Inside, Outside
crv_38 = Curve(trim_68.Inside)
item_284 = ListItem(List=end_40.End, Index=Slider(86, range=0..1000), Wrap=True)
item_285 = ListItem(List=end_40.Start, Index=Slider(652, range=0..1000), Wrap=item_284)
dist_62 = Distance(PointA=item_285, PointB=item_284)
panel_72 = Panel(dist_62)

divide_73 = DivideDomain²(Domain=debrep_42.Faces, UCount=number_slider_65, VCount=number_slider_64)
subsrf_33 = Isotrim(Surface=debrep_42.Faces, Domain=divide_73)
area_46 = Area(Geometry=subsrf_33)  # -> Area, Centroid
line_33 = LineSDL(Start=area_46.Centroid, Direction=Y_8, Length=Slider(8, range=0..10))
lng_33 = ListLength(List=line_33)
series_33 = Series(Start=0, Step=1, Count=lng_33)
evalsrf_33 = EvaluateSurface(Surface=debrep_42.Faces, Point=vec_134.Vector)  # -> Point, Normal, UDirection, VDirection, Frame
mod_33 = Modulus(A=series_33, B="2")
equals_33 = Equality(FirstNumber=mod_33, SecondNumber="0")  # -> Equality, Inequality
cull_39 = CullPattern(List=line_33, CullPattern=equals_33.Inequality)
extr_33 = Extrude(Base=debrep_42.Faces, Direction=evalsrf_33.Normal)
end_41 = EndPoints(Curve=cull_39)  # -> Start, End
move_65 = Move(Geometry=extr_33, Motion=vec_135.Vector)  # -> Geometry, Transform
trim_69 = TrimWithBrep(Curve=cull_39, Brep=move_65.Geometry)  # -> Inside, Outside
move_66 = Move(Geometry=extr_33, Motion=vec_136.Vector)  # -> Geometry, Transform
trim_70 = TrimWithBrep(Curve=trim_69.Inside, Brep=move_66.Geometry)  # -> Inside, Outside
crv_39 = Curve(trim_70.Inside)
item_286 = ListItem(List=end_41.End, Index=Slider(86, range=0..1000), Wrap=True)
item_287 = ListItem(List=end_41.Start, Index=Slider(652, range=0..1000), Wrap=item_286)
dist_63 = Distance(PointA=item_287, PointB=item_286)
panel_73 = Panel(dist_63)

divide_74 = DivideCurve(Curve=cull_37, Count=10, Kinks=False)  # -> flatten(Points), Tangents, Parameters
divide_75 = DivideCurve(Curve=cull_39, Count=10, Kinks=False)  # -> flatten(Points), Tangents, Parameters

item_288 = ListItem(List=divide_74.Points, Index=Slider(156, range=0..1000), Wrap=True)
item_289 = ListItem(List=divide_74.Points, Index=Slider(305, range=0..1000), Wrap=True)
dist_64 = Distance(PointA=item_288, PointB=item_289)
panel_74 = Panel(dist_64)

item_290 = ListItem(List=divide_75.Points, Index=Slider(156, range=0..1000), Wrap=True)
item_291 = ListItem(List=divide_75.Points, Index=Slider(305, range=0..1000), Wrap=True)
dist_65 = Distance(PointA=item_290, PointB=item_291)
panel_75 = Panel(dist_65)

merge_16 = Merge(
    Data1=crv_15,
    Data2=crv_39,
    Data3=crv_29,
    Data4=crv_30,
    Data5=crv_31,
    Data6=crv_37,
    Data7=crv_28,
    Data8=crv_27,
    Data9=crv_14,
    Data10=crv_13,
    Data11=crv_10,
    Data12=crv_12,
    Data13=crv_11,
    Data14=crv_8,
    Data15=crv_7,
    Data16=crv_9)

divide_76 = DivideDomain²(Domain=debrep_44.Faces, UCount=number_slider_69, VCount=number_slider_68)
subsrf_34 = Isotrim(Surface=debrep_44.Faces, Domain=divide_76)
area_47 = Area(Geometry=subsrf_34)  # -> Area, Centroid
evalsrf_34 = EvaluateSurface(Surface=debrep_44.Faces, Point=vec_139.Vector)  # -> Point, Normal, UDirection, VDirection, Frame
line_34 = LineSDL(Start=area_47.Centroid, Direction=evalsrf_34.UDirection, Length=Slider(8, range=0..10))
lng_34 = ListLength(List=line_34)
series_34 = Series(Start=0, Step=1, Count=lng_34)
mod_34 = Modulus(A=series_34, B="2")
equals_34 = Equality(FirstNumber=mod_34, SecondNumber="0")  # -> Equality, Inequality
cull_40 = CullPattern(List=line_34, CullPattern=equals_34.Inequality)
extr_34 = Extrude(Base=debrep_44.Faces, Direction=evalsrf_34.Normal)
end_42 = EndPoints(Curve=cull_40)  # -> Start, End
move_67 = Move(Geometry=extr_34, Motion=vec_140.Vector)  # -> Geometry, Transform
trim_71 = TrimWithBrep(Curve=cull_40, Brep=move_67.Geometry)  # -> Inside, Outside
move_68 = Move(Geometry=extr_34, Motion=vec_141.Vector)  # -> Geometry, Transform
trim_72 = TrimWithBrep(Curve=trim_71.Inside, Brep=move_68.Geometry)  # -> Inside, Outside
crv_40 = Curve(trim_72.Inside)
item_292 = ListItem(List=end_42.End, Index=Slider(86, range=0..1000), Wrap=True)
item_293 = ListItem(List=end_42.Start, Index=Slider(652, range=0..1000), Wrap=item_292)
dist_66 = Distance(PointA=item_293, PointB=item_292)
panel_76 = Panel(dist_66)

divide_77 = DivideCurve(Curve=cull_38, Count=10, Kinks=False)  # -> flatten(Points), Tangents, Parameters
divide_78 = DivideCurve(Curve=cull_40, Count=10, Kinks=False)  # -> flatten(Points), Tangents, Parameters

item_294 = ListItem(List=divide_77.Points, Index=Slider(156, range=0..1000), Wrap=True)
item_295 = ListItem(List=divide_77.Points, Index=Slider(305, range=0..1000), Wrap=True)
dist_67 = Distance(PointA=item_294, PointB=item_295)
panel_77 = Panel(dist_67)

item_296 = ListItem(List=divide_78.Points, Index=Slider(156, range=0..1000), Wrap=True)
item_297 = ListItem(List=divide_78.Points, Index=Slider(305, range=0..1000), Wrap=True)
dist_68 = Distance(PointA=item_296, PointB=item_297)
panel_78 = Panel(dist_68)

merge_17 = Merge(
    Data1=crv_25,
    Data2=crv_40,
    Data3=crv_34,
    Data4=crv_35,
    Data5=crv_36,
    Data6=crv_38,
    Data7=crv_33,
    Data8=crv_32,
    Data9=crv_24,
    Data10=crv_23,
    Data11=crv_20,
    Data12=crv_22,
    Data13=crv_21,
    Data14=crv_17,
    Data15=crv_16,
    Data16=crv_18,
    Data17=crv_19,
    Data18=crv_26)
